# Grasshopper definition light_simu_test_ASIM.gh (Grasshopper 1.0.8)
# plug-ins: ClimateStudioGH, Bifocals, XiRui

# 4 classes ceiling light
panel = Panel("Linear 4' Direct (Flood) - 3900 lm - ceiling - 0/5")
getcsluminaireproduct = GetCSLuminaireProduct(SearchName="Linear 4' Direct (Flood) - 3900 lm - task - 1/6", UnitSystem=4)
getcsluminaireproduct_2 = GetCSLuminaireProduct(SearchName="Linear 4' Direct (Flood) - 3900 lm - task - 2/6", UnitSystem=4)
getcsluminaireproduct_3 = GetCSLuminaireProduct(SearchName="Linear 4' Direct (Flood) - 3900 lm - task - 0/6", UnitSystem=4)

# ----
# output plan image, snapshot1 with 512*512 topView
panel_2 = Panel("C:\Users\e1583443\OneDrive\NUS\2025fall\ai\2025Sp_AI_Sustain_Project\dataset\training\augmented_dataset.xlsx")
python_3_script = Python3Script(file_path=panel_2, id_in=Slider(1801, range=0..1801))  # -> out, seat_on
# ---------- python_3_script: Python ----------
"""
Inputs:
    id_in:       要读取的行 id (int)
    file_path:   xlsx 或 csv 文件完整路径 (str)
Outputs:
    seat_on:     当前行中 seat_xx == 1 的编号列表 (list of int)
"""

import pandas as pd
import os

def load_table(file_path):
    """自动判断文件格式并读取"""
    
    ext = os.path.splitext(file_path)[1].lower()
    
    if ext == ".csv":
        return pd.read_csv(file_path)
    
    elif ext in [".xlsx", ".xls"]:
        # Grasshopper 通常不会知道 sheet name，所以优先尝试默认读取第一个 sheet
        try:
            return pd.read_excel(file_path, sheet_name="dataset")
        except:
            return pd.read_excel(file_path)  # 读第一个sheet
    
    else:
        raise ValueError(f"Unsupported file type: {ext}")

def get_active_seats(file_path, row_id):
    
    df = load_table(file_path)

    # 检查 row 是否存在
    if row_id < 0 or row_id >= len(df):
        return []

    row = df.iloc[row_id]

    seats = []
    # seat 支持 seat_0 ~ seat_23 或 seat_00 ~ seat_23 格式
    for i in range(24):
        col_1 = f"seat_{i}"
        col_2 = f"seat_{i:02d}"

        if col_2 in row and row[col_2] == 1:
            seats.append(i)
        elif col_1 in row and row[col_1] == 1:
            seats.append(i)

    return seats


# === 运行 ===
try:
    seat_on = get_active_seats(file_path, int(id_in))
except Exception as e:
    seat_on = f"Error: {e}"
# ---------- end python_3_script ----------
brep = Brep([<brep referenced from the Rhino model> x24])
panel_3 = Panel(python_3_script.seat_on)
list_item = ListItem(List=brep, Index=panel_3, Wrap=True)
bounding_box = BoundingBox(Content=brep, Plane=PlaneXY(0, 0, 0))  # -> Box, Box_2; disabled
volume = Volume(Geometry=bounding_box.Box)  # -> Volume, Centroid; disabled
custom_preview = CustomPreview(Geometry=list_item, Material=ColourSwatch(SwatchColor=RGB(0, 0, 0)))
point_list = PointList(Points=volume.Centroid)  # disabled

getcsluminaireproduct_4 = GetCSLuminaireProduct(SearchName="Linear 4' Direct (Flood) - 3900 lm - ceiling - 6/5", UnitSystem=4)
getcsluminaireproduct_5 = GetCSLuminaireProduct(SearchName=panel, UnitSystem=4)
getcsluminaireproduct_6 = GetCSLuminaireProduct(SearchName="Linear 4' Direct (Flood) - 3900 lm - ceiling - 1/5", UnitSystem=4)
getcsluminaireproduct_7 = GetCSLuminaireProduct(SearchName="Linear 4' Direct (Flood) - 3900 lm - ceiling - 2/5", UnitSystem=4)
getcsluminaireproduct_8 = GetCSLuminaireProduct(SearchName="Linear 4' Direct (Flood) - 3900 lm - ceiling - 7/5", UnitSystem=4)
getcsluminaireproduct_9 = GetCSLuminaireProduct(SearchName="Linear 4' Direct (Flood) - 3900 lm - ceiling - 8/5", UnitSystem=4)
getcsluminaireproduct_10 = GetCSLuminaireProduct(SearchName="Linear 4' Direct (Flood) - 3900 lm - ceiling - 4/5", UnitSystem=4)
getcsluminaireproduct_11 = GetCSLuminaireProduct(SearchName="Linear 4' Direct (Flood) - 3900 lm - ceiling - 3/5", UnitSystem=4)
panel_4 = Panel("C:\Users\e1583443\OneDrive\NUS\2025fall\ai\2025Sp_AI_Sustain_Project\simulated_seats.csv")
sky = ConstructCSSky(
    Type="CIE_Clear",
    Weather="SGP_SG_Changi.Intl.AP.486980_TMYx.2004-2018",
    Month=9,
    Day=21,
    Hour=12,
    Input_0_Hidden=False,
    Input_0_Name="Type",
    Input_10_Hidden=True,
    Input_10_Name="Turbidity",
    Input_11_Hidden=True,
    Input_11_Name="Year",
    Input_12_Hidden=True,
    Input_12_Name="Condition",
    Input_1_Hidden=False,
    Input_1_Name="Weather",
    Input_2_Hidden=False,
    Input_2_Name="Month",
    Input_3_Hidden=False,
    Input_3_Name="Day",
    Input_4_Hidden=False,
    Input_4_Name="Hour",
    Input_5_Hidden=True,
    Input_5_Name="GHI",
    Input_6_Hidden=True,
    Input_6_Name="Direct",
    Input_7_Hidden=True,
    Input_7_Name="Diffuse",
    Input_8_Hidden=True,
    Input_8_Name="Ground Albedo",
    Input_9_Hidden=True,
    Input_9_Name="Ground Source",
    UnitSystem=4,
    Input_8_GHParam_Branch0_Path="{0}",
    Input_8_GHParam_Branch0_Item0_number=0.2,
    Input_9_GHParam_Branch0_Path="{0}",
    Input_9_GHParam_Branch0_Item0_boolean=True,
    Input_10_GHParam_Branch0_Path="{0}",
    Input_10_GHParam_Branch0_Item0_number=3,
    Input_11_GHParam_Branch0_Path="{0}",
    Input_11_GHParam_Branch0_Item0_number=2021,
    Input_12_GHParam_Branch0_Path="{0}",
    Input_12_GHParam_Branch0_Item0_null_string=False,
    Input_12_GHParam_Branch0_Item0_string="Clear")

# ----
# Spider Galapagos
add1 = Slider(10, range=0..10)  # disabled
add0 = Slider(10, range=0..10)  # disabled
number_slider = Slider(37, range=0..100)  # disabled
number_slider_2 = Slider(10, range=0..10)  # disabled
boolean_toggle = BooleanToggle(True)  # disabled
boolean_toggle_2 = BooleanToggle(False)  # disabled
panel_5 = Panel("""add0
add1""")  # disabled
boolean_toggle_3 = BooleanToggle(True)  # disabled
addition = Addition(A=add0, B=add1)  # disabled
c_script = CSharpScript(Pop=number_slider_2, Gen=number_slider_2, Seed=number_slider, Start=boolean_toggle_2, ApplyBest=boolean_toggle)  # -> Best, BestVals, GenIdx, IndIdx; inputs G: list, Obj: Double, Pop: Int32, Gen: Int32, Seed: Int32, Start: Boolean, ApplyBest: Boolean; disabled
# ---------- c_script: C# ----------
/// <summary>
/// Grasshopper C# Script Component
/// Inputs:
///   G (List<GH_NumberSlider>)  // 基因：一组 Number Slider
///   Obj (double)               // 目标值（越小越好）
///   Pop (int)                  // 种群规模
///   Gen (int)                  // 代数
///   Seed (int)                 // 随机种子
///   Start (bool)               // 开始/重启
///   ApplyBest (bool)           // 应用最佳个体到滑条
/// Outputs:
///   Best                       // 当前最佳目标值
///   BestVals (List<double>)    // 当前最佳个体的各基因值
///   GenIdx                     // 当前代索引（从 0 开始）
///   IndIdx                     // 当前代内个体索引
/// </summary>

using System;
using System.Collections.Generic;
using Grasshopper;
using Grasshopper.Kernel;
using Grasshopper.Kernel.Special;
using Rhino;

public class Script_Instance : GH_ScriptInstance
{
  // === 持久化 GA 状态（静态，跨解保存） ===
  static bool running = false;
  static int genCount, popSize;
  static int currentGen, currentInd;
  static Random rnd;
  static List<GH_NumberSlider> sliders;
  static List<double[]> population;     // 基因
  static double[] fitness;              // 适应度（目标值）
  static List<double[]> nextPopulation;
  static double[] bestGenome;
  static double bestFit;
  static bool awaitingEval = false;     // 标记：已设置基因，等待下一次解返回 Obj
  static int geneCount;
  static double[] mins, maxs, steps;

  // 参数
  static double mutationRate = 0.15;
  static double mutationSigma = 0.1;    // 相对范围的高斯扰动
  static double eliteRatio   = 0.05;
  static int tournamentK     = 3;

 // 在 "RunScript" 区域粘贴以下代码
private void RunScript(
		List<object> G,
		double Obj,
		int Pop,
		int Gen,
		int Seed,
		bool Start,
		bool ApplyBest,
		ref object Best,
		ref object BestVals,
		ref object GenIdx,
		ref object IndIdx)
{
  // —— 安全拿到 sliders —— //
  var sliders = CollectSliders(G);
  if (sliders == null || sliders.Count == 0)
  {
    Best = "No sliders.";
    BestVals = new List<double>();
    GenIdx = 0;
    IndIdx = -1;
    return;
  }

  if (Pop < 2) Pop = 2;
  if (Gen < 1) Gen = 1;

  // 初始化/重启
  if (Start || _state == null || _state.GeneCount != sliders.Count)
  {
    _state = new GAState(sliders, Pop, Gen, Seed);
    // 第一个个体下到滑条并调度一次求解
    SetSliders(_state, sliders, _state.Population[0]);
    ScheduleNext();
  }

  // 如果刚刚设过基因，当前这次解返回，把目标值记进去并推进
  if (_state.Running && _state.AwaitingEval)
  {
    _state.Fitness[_state.CurrentInd] = Obj;

    if (Obj < _state.BestFit)
    {
      _state.BestFit = Obj;
      _state.BestGenome = (double[]) _state.Population[_state.CurrentInd].Clone();
    }

    _state.CurrentInd++;

    if (_state.CurrentInd >= _state.PopSize)
    {
      // 一代结束
      _state.CurrentGen++;
      if (_state.CurrentGen >= _state.GenCount)
      {
        _state.Running = false;
      }
      else
      {
        Evolve(_state);
        _state.CurrentInd = 0;
      }
    }

    if (_state.Running)
    {
      SetSliders(_state, sliders, _state.Population[_state.CurrentInd]);
      ScheduleNext();
    }

    _state.AwaitingEval = false;
  }

  // 应用最佳解到滑条
  if (ApplyBest && _state != null && _state.BestGenome != null)
  {
    SetSliders(_state, sliders, _state.BestGenome);
    this.Component.OnPingDocument()?.NewSolution(false);
  }

  // 输出
  Best = _state != null ? _state.BestFit : double.NaN;
  BestVals = (_state != null && _state.BestGenome != null) ? new List<double>(_state.BestGenome) : new List<double>();
  GenIdx = _state != null ? _state.CurrentGen : 0;
  IndIdx = (_state != null && _state.Running) ? _state.CurrentInd : -1;
}


// ======== 辅助函数与状态（放在 "Additional code" 区域） ========

static GAState _state;

class GAState
{
  public bool Running = true;
  public bool AwaitingEval = true;

  public int PopSize, GenCount, CurrentGen, CurrentInd, GeneCount;
  public Random Rnd;

  public List<double[]> Population;
  public double[] Fitness;
  public List<double[]> NextPopulation;

  public double[] BestGenome;
  public double BestFit = double.PositiveInfinity;

  public double[] Mins, Maxs, Steps;

  public GAState(List<GH_NumberSlider> sliders, int pop, int gen, int seed)
  {
    PopSize = pop;
    GenCount = gen;
    CurrentGen = 0;
    CurrentInd = 0;
    Rnd = new Random(seed);

    GeneCount = sliders.Count;
    Mins = new double[GeneCount];
    Maxs = new double[GeneCount];
    Steps = new double[GeneCount];

    for (int i = 0; i < GeneCount; i++)
    {
      var s = sliders[i];
      Mins[i] = (double) s.Slider.Minimum;
      Maxs[i] = (double) s.Slider.Maximum;
      int dp = Math.Max(0, s.Slider.DecimalPlaces);
      Steps[i] = (dp > 0) ? Math.Pow(10, -dp) : 1.0;
      if (Mins[i] > Maxs[i]) { var t = Mins[i]; Mins[i] = Maxs[i]; Maxs[i] = t; }
    }

    Population = new List<double[]>(PopSize);
    Fitness = new double[PopSize];

    for (int p = 0; p < PopSize; p++)
      Population.Add(RandomGenome());
  }

  public double[] RandomGenome()
  {
    var g = new double[GeneCount];
    for (int i = 0; i < GeneCount; i++)
    {
      double t = Rnd.NextDouble();
      g[i] = RoundToStep(Mins[i] + t * (Maxs[i] - Mins[i]), Steps[i]);
    }
    return g;
  }

  public static double RoundToStep(double v, double step)
  {
    if (step <= 0) return v;
    return Math.Round(v / step) * step;
  }
}

List<GH_NumberSlider> CollectSliders(List<object> G)
{
  var list = new List<GH_NumberSlider>();
  foreach (var x in G)
  {
    if (x is GH_NumberSlider s) list.Add(s);
  }
  return list;
}

void SetSliders(GAState st, List<GH_NumberSlider> sliders, double[] genome)
{
  for (int i = 0; i < st.GeneCount; i++)
  {
    var s = sliders[i];
    double v = Clamp(genome[i], st.Mins[i], st.Maxs[i]);
    v = GAState.RoundToStep(v, st.Steps[i]);
    s.SetSliderValue((decimal) v);
    s.ExpireSolution(false);
  }
  st.AwaitingEval = true;
}

void ScheduleNext()
{
  var doc = this.Component.OnPingDocument();
  if (doc == null) return;
  doc.ScheduleSolution(1, _ => { /* 触发一次求解 */ });
}

double Clamp(double v, double a, double b) => Math.Max(a, Math.Min(b, v));

// —— GA 算子 —— //
double MutationRate = 0.15;
double MutationSigma = 0.1;   // 相对范围的高斯扰动
double EliteRatio   = 0.05;
int TournamentK     = 3;

void Evolve(GAState st)
{
  int elites = Math.Max(1, (int) Math.Round(st.PopSize * EliteRatio));
  var idx = new List<int>(st.PopSize);
  for (int i = 0; i < st.PopSize; i++) idx.Add(i);
  idx.Sort((a, b) => st.Fitness[a].CompareTo(st.Fitness[b]));

  st.NextPopulation = new List<double[]>(st.PopSize);

  // 精英
  for (int i = 0; i < elites; i++)
    st.NextPopulation.Add((double[]) st.Population[idx[i]].Clone());

  // 其余
  while (st.NextPopulation.Count < st.PopSize)
  {
    int pa = Tournament(st);
    int pb = Tournament(st);
    var child = Crossover(st, st.Population[pa], st.Population[pb]);
    Mutate(st, child);
    st.NextPopulation.Add(child);
  }

  st.Population = st.NextPopulation;
  st.Fitness = new double[st.PopSize];
}

int Tournament(GAState st)
{
  int best = -1;
  double bestF = double.PositiveInfinity;
  for (int i = 0; i < TournamentK; i++)
  {
    int k = st.Rnd.Next(st.PopSize);
    if (st.Fitness[k] < bestF) { bestF = st.Fitness[k]; best = k; }
  }
  return best;
}

double[] Crossover(GAState st, double[] a, double[] b)
{
  var child = new double[st.GeneCount];
  int cp = st.Rnd.Next(st.GeneCount);
  for (int i = 0; i < st.GeneCount; i++)
    child[i] = (i < cp) ? a[i] : b[i];
  return child;
}

void Mutate(GAState st, double[] g)
{
  for (int i = 0; i < st.GeneCount; i++)
  {
    if (st.Rnd.NextDouble() < MutationRate)
    {
      double range = st.Maxs[i] - st.Mins[i];
      double delta = NextGaussian(st, 0, MutationSigma * range);
      g[i] = Clamp(g[i] + delta, st.Mins[i], st.Maxs[i]);
    }
    g[i] = GAState.RoundToStep(g[i], st.Steps[i]);
  }
}

double NextGaussian(GAState st, double mean, double stddev)
{
  // Box–Muller
  double u1 = 1.0 - st.Rnd.NextDouble();
  double u2 = 1.0 - st.Rnd.NextDouble();
  double z0 = Math.Sqrt(-2.0 * Math.Log(u1)) * Math.Cos(2.0 * Math.PI * u2);
  return mean + z0 * stddev;
}}
# ---------- end c_script ----------
c_script_2 = CSharpScript(Names=panel_5, Obj=addition, Pop=number_slider_2, Gen=number_slider_2, Seed=number_slider, ApplyBest=boolean_toggle)  # -> out, Best, BestVals, GenIdx, IndIdx, Status; inputs Names: list of String, Obj: Double, Pop: Int32, Gen: Int32, Seed: Int32, ApplyBest: Boolean; disabled
# ---------- c_script_2: C# ----------
// ==============================================
// Rhino 8 / Grasshopper C#  — GA Controller (NickName)
// Auto-restart on Seed/Pop/Gen/Names change
// Logs with Print()  → enable "Standard Output/Error Parameter ("out")"
// ==============================================
using System;
using System.Collections.Generic;
using Grasshopper;
using Grasshopper.Kernel.Special;
using Grasshopper.Kernel;
using Grasshopper.Kernel.Data;
using Grasshopper.Kernel.Types;
using Rhino;
using Rhino.Geometry;


// ---------- 组件内记忆容器（会话内持久；若你发现不持久，可改为 RhinoDoc.Strings 方案） ----------
Dictionary<string, object> _memory = new Dictionary<string, object>();

// ---------- GA 参数（可调） ----------
const double MUTATION_RATE  = 0.15;
const double MUTATION_SIGMA = 0.10;
const double ELITE_RATIO    = 0.05;
const int    TOURNAMENT_K   = 3;

// ---------- GA 状态 ----------
class GAState
{
  public bool Running = true;
  public bool AwaitingEval = true;

  public readonly int PopSize, GenCount;
  public int CurrentGen = 0, CurrentInd = 0;
  public readonly int GeneCount;
  public readonly Random Rnd;

  public List<double[]> Population;
  public double[] Fitness;
  public List<double[]> NextPopulation;

  public double[] BestGenome;
  public double BestFit = double.PositiveInfinity;

  public readonly double[] Mins, Maxs, Steps;

  public GAState(List<GH_NumberSlider> sliders, int pop, int gen, int seed)
  {
    PopSize = Math.Max(2, pop);
    GenCount = Math.Max(1, gen);
    Rnd = new Random(seed);

    GeneCount = sliders.Count;
    Mins  = new double[GeneCount];
    Maxs  = new double[GeneCount];
    Steps = new double[GeneCount];

    for (int i = 0; i < GeneCount; i++)
    {
      var s = sliders[i];
      Mins[i] = (double)s.Slider.Minimum;
      Maxs[i] = (double)s.Slider.Maximum;
      int dp  = Math.Max(0, s.Slider.DecimalPlaces);
      Steps[i] = (dp > 0) ? Math.Pow(10, -dp) : 1.0;
      if (Mins[i] > Maxs[i]) { var t = Mins[i]; Mins[i] = Maxs[i]; Maxs[i] = t; }
    }

    Population = new List<double[]>(PopSize);
    Fitness = new double[PopSize];
    for (int p = 0; p < PopSize; p++)
      Population.Add(RandomGenome());
  }

  public double[] RandomGenome()
  {
    var g = new double[GeneCount];
    for (int i = 0; i < GeneCount; i++)
    {
      double t = Rnd.NextDouble();
      g[i] = RoundToStep(Mins[i] + t * (Maxs[i] - Mins[i]), Steps[i]);
    }
    return g;
  }

  public static double RoundToStep(double v, double step)
  {
    if (step <= 0) return v;
    return Math.Round(v / step) * step;
  }
}

// ---------- 工具：按 NickName 收集 Slider ----------
List<GH_NumberSlider> CollectSlidersByNames(List<string> names)
{
  var result = new List<GH_NumberSlider>();
  var doc = Grasshopper.Instances.ActiveCanvas?.Document;
  if (doc == null || names == null || names.Count == 0) return result;

  var map = new Dictionary<string, GH_NumberSlider>(StringComparer.OrdinalIgnoreCase);
  foreach (var obj in doc.Objects)
  {
    var s = obj as GH_NumberSlider;
    if (s == null) continue;
    string key = (s.NickName ?? "").Trim();
    if (key.Length > 0 && !map.ContainsKey(key))
      map[key] = s;
  }

  for (int i = 0; i < names.Count; i++)
  {
    string key = (names[i] ?? "").Trim();
    if (key.Length == 0) continue;
    GH_NumberSlider s;
    if (map.TryGetValue(key, out s)) result.Add(s);
  }
  return result;
}

// ---------- 把一个个体写到滑条 ----------
void SetSliders(GAState st, List<GH_NumberSlider> sliders, double[] genome)
{
  for (int i = 0; i < st.GeneCount; i++)
  {
    var s = sliders[i];
    double v = Clamp(genome[i], st.Mins[i], st.Maxs[i]);
    v = GAState.RoundToStep(v, st.Steps[i]);
    s.SetSliderValue((decimal)v);
    s.ExpireSolution(false);
  }
  st.AwaitingEval = true;
}

// ---------- 调度下一次求解（推进 GA） ----------
void ScheduleNext()
{
  var doc = Grasshopper.Instances.ActiveCanvas?.Document;
  if (doc == null) return;
  // 只要安排一次求解即可，滑条已被 Expire，会触发新一轮
  doc.ScheduleSolution(1, _ => { });
}

// ---------- GA 算子 ----------
void Evolve(GAState st)
{
  int elites = Math.Max(1, (int)Math.Round(st.PopSize * ELITE_RATIO));
  var idx = new List<int>(st.PopSize);
  for (int i = 0; i < st.PopSize; i++) idx.Add(i);
  idx.Sort((a, b) => st.Fitness[a].CompareTo(st.Fitness[b]));

  st.NextPopulation = new List<double[]>(st.PopSize);
  for (int i = 0; i < elites; i++)
    st.NextPopulation.Add((double[])st.Population[idx[i]].Clone());

  while (st.NextPopulation.Count < st.PopSize)
  {
    int pa = Tournament(st);
    int pb = Tournament(st);
    var child = Crossover(st, st.Population[pa], st.Population[pb]);
    Mutate(st, child);
    st.NextPopulation.Add(child);
  }

  st.Population = st.NextPopulation;
  st.Fitness = new double[st.PopSize];
}

int Tournament(GAState st)
{
  int best = -1;
  double bestF = double.PositiveInfinity;
  for (int i = 0; i < TOURNAMENT_K; i++)
  {
    int k = st.Rnd.Next(st.PopSize);
    if (st.Fitness[k] < bestF) { bestF = st.Fitness[k]; best = k; }
  }
  return best;
}

double[] Crossover(GAState st, double[] a, double[] b)
{
  var child = new double[st.GeneCount];
  int cp = st.Rnd.Next(st.GeneCount);
  for (int i = 0; i < st.GeneCount; i++)
    child[i] = (i < cp) ? a[i] : b[i];
  return child;
}

void Mutate(GAState st, double[] g)
{
  for (int i = 0; i < st.GeneCount; i++)
  {
    if (st.Rnd.NextDouble() < MUTATION_RATE)
    {
      double range = st.Maxs[i] - st.Mins[i];
      double delta = NextGaussian(st, 0, MUTATION_SIGMA * range);
      g[i] = Clamp(g[i] + delta, st.Mins[i], st.Maxs[i]);
    }
    g[i] = GAState.RoundToStep(g[i], st.Steps[i]);
  }
}

// ---------- 数学工具 ----------
double NextGaussian(GAState st, double mean, double stddev)
{
  double u1 = 1.0 - st.Rnd.NextDouble();
  double u2 = 1.0 - st.Rnd.NextDouble();
  double z0 = Math.Sqrt(-2.0 * Math.Log(u1)) * Math.Cos(2.0 * Math.PI * u2);
  return mean + z0 * stddev;
}
double Clamp(double v, double a, double b) => Math.Max(a, Math.Min(b, v));

void Print(string msg)
{
    // 若无 Component 对象，则写入 Rhino 命令行
    RhinoApp.WriteLine(msg);
}


// ==============================================
// RunScript
// ==============================================
void RunScript(
  List<string> Names,
  double Obj,
  int Pop,
  int Gen,
  int Seed,
  bool Start,          // 可不连
  bool ApplyBest,
  ref object Best,
  ref object BestVals,
  ref object GenIdx,
  ref object IndIdx,
  ref object Status    // 最后一个输出
)
{
  // —— 默认输出（避免任何分支出现 null）——
  string status = "IDLE";
  Best = double.NaN; BestVals = new List<double>(); GenIdx = 0; IndIdx = -1; Status = status;

  // 取历史状态
  GAState state  = _memory.ContainsKey("GA_state") ? (GAState)_memory["GA_state"] : null;

  // 收集滑条并打印自检
  var sliders = CollectSlidersByNames(Names);
  Print($"[GA] Names: {(Names==null?0:Names.Count)}  →  Found sliders: {sliders.Count}");
  if (Names != null) foreach (var n in Names) Print($"[GA]  Name: \"{n}\"");

  if (sliders == null || sliders.Count == 0)
  {
    Print("[GA] NO_SLIDER: 未找到任何 NickName 匹配的滑条。检查 Slider 右键 Rename 的 NickName 与 Names 面板逐字一致。");
    Status = "NO_SLIDER";
    return;
  }

  // 读取配置签名（用于自动重启）
  int prevSeed = _memory.ContainsKey("GA_seed") ? (int)_memory["GA_seed"] : int.MinValue;
  int prevPop  = _memory.ContainsKey("GA_pop")  ? (int)_memory["GA_pop"]  : int.MinValue;
  int prevGen  = _memory.ContainsKey("GA_gen")  ? (int)_memory["GA_gen"]  : int.MinValue;
  string prevNamesSig = _memory.ContainsKey("GA_namesSig") ? (string)_memory["GA_namesSig"] : "";
  string namesSig = (Names == null || Names.Count == 0) ? "" : string.Join("|", Names);

  bool needInit =
       state == null
    || state.GeneCount != sliders.Count
    || Seed != prevSeed
    || Pop  != prevPop
    || Gen  != prevGen
    || namesSig != prevNamesSig;

  if (needInit)
  {
    if (Pop < 2) Pop = 2;
    if (Gen < 1) Gen = 1;

    state = new GAState(sliders, Pop, Gen, Seed);
    SetSliders(state, sliders, state.Population[0]); // 写入第一个个体
    ScheduleNext();                                  // 安排下一帧推进
    Print($"[GA] INIT  Seed={Seed}, Pop={Pop}, Gen={Gen}, Genes={state.GeneCount}");
    status = "INIT";

    // 保存签名
    _memory["GA_seed"] = Seed;
    _memory["GA_pop"]  = Pop;
    _memory["GA_gen"]  = Gen;
    _memory["GA_namesSig"] = namesSig;

    // 初始化时给出基础输出并返回，等下一帧回来评估 Obj
    Best = state.BestFit;
    BestVals = new List<double>();
    GenIdx = state.CurrentGen;
    IndIdx = state.CurrentInd;
    Status = status;
    _memory["GA_state"] = state;
    return;
  }

  // 推进（评估上一帧设置的个体）
  if (double.IsNaN(Obj) || double.IsInfinity(Obj))
  {
    Print("[GA] NO_OBJ: Obj 未连接或不是有效数值（NaN/Inf）。请把你的目标函数(double)连到 Obj。");
    Status = "NO_OBJ";
    _memory["GA_state"] = state;
    return;
  }

  if (state.Running && state.AwaitingEval)
  {
    state.Fitness[state.CurrentInd] = Obj;

    if (Obj < state.BestFit)
    {
      state.BestFit = Obj;
      state.BestGenome = (double[])state.Population[state.CurrentInd].Clone();
    }

    state.CurrentInd++;
    if (state.CurrentInd >= state.PopSize)
    {
      state.CurrentGen++;
      if (state.CurrentGen >= state.GenCount)
      {
        state.Running = false;
        Print("[GA] DONE");
        status = "DONE";
      }
      else
      {
        Evolve(state);
        state.CurrentInd = 0;
        status = "STEP";
      }
    }
    else
    {
      status = "STEP";
    }

    if (state.Running)
    {
      SetSliders(state, sliders, state.Population[state.CurrentInd]); // 写下一位个体
      ScheduleNext(); // 再安排一次求解
    }

    state.AwaitingEval = false;
  }
  else
  {
    // 刚初始化完或等待下一帧
    if (state.Running) status = "INIT";
  }

  // 随时应用最佳解
  if (ApplyBest && state != null && state.BestGenome != null)
  {
    SetSliders(state, sliders, state.BestGenome);
    Print("[GA] ApplyBest → 已把最优解写回滑条。");
  }

  // —— 输出 —— //
  Best = state != null ? state.BestFit : double.NaN;
  BestVals = (state != null && state.BestGenome != null) ? new List<double>(state.BestGenome) : new List<double>();
  GenIdx = state != null ? state.CurrentGen : 0;
  IndIdx = (state != null && state.Running) ? state.CurrentInd : -1;
  Status = status;

  _memory["GA_state"] = state;

  if (state != null)
    Print($"[GA] {status}: Gen {state.CurrentGen}/{state.GenCount} | Ind {state.CurrentInd}/{state.PopSize} | Best {state.BestFit}");
}
# ---------- end c_script_2 ----------
panel_6 = Panel(c_script_2.Status)  # disabled
panel_7 = Panel(c_script_2.out)  # disabled
panel_8 = Panel(c_script_2.IndIdx)  # disabled
panel_9 = Panel(c_script_2.BestVals)  # disabled
panel_10 = Panel(c_script_2.GenIdx)  # disabled
panel_11 = Panel(c_script_2.Best)  # disabled

number_slider_3 = Slider(0, range=0..3173)
ceiling = Brep([<brep referenced from the Rhino model> x5000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])
number_slider_4 = Slider(6, range=0..10)  # disabled

# ----
# new ceiling lights position
curve = Curve(graft([<curve referenced from the Rhino model> x3]))
end_points = EndPoints(Curve=curve)  # -> Start, End
curve_middle = CurveMiddle(Curve=curve)
vector_xyz = VectorXYZ(XComponent=0, YComponent=0, ZComponent=Slider(2.35, range=0..10))  # -> Vector, Length
move = Move(Geometry=[curve_middle, end_points.Start, end_points.End], Motion=vector_xyz.Vector)  # -> simplify(Geometry), Transform
explode_tree = ExplodeTree(Data=move.Geometry)  # -> Branch0, Branch1, Branch2
point = Point(explode_tree.Branch0)
point_2 = Point(explode_tree.Branch2)
point_3 = Point(explode_tree.Branch1)

ceiling_light_full_load_power = Panel("9")  # disabled
changegui = ChangeGui(
    Switcher=ColourSwatch(SwatchColor=RGB(255, 255, 255)),
    Canvas_back=ColourSwatch(SwatchColor=RGB(19, 93, 105)),
    Canvas_grid=ColourSwatch(SwatchColor=RGB(143, 143, 143)),
    Canvas_wire=RGB(255, 255, 255))
division = Division(A=ceiling_light_full_load_power, B=number_slider_4)  # disabled
get_cs_lightingmaterial = GetCSLightingMaterial(Search="ceiling lm83", UnitSystem=4)
seed = Slider(366, range=0..1200)
# 现在用seed控制人的分布就好了,可以手动控制人数人数从1-11
number_slider_5 = Slider(5, range=0..23)
ceiling_2 = Brep([<brep referenced from the Rhino model> x72])
grid = Brep(<brep referenced from the Rhino model>)
task_light_level = Slider(0, range=0..6)  # disabled
get_cs_lightingmaterial_2 = GetCSLightingMaterial(UnitSystem=4)

# ----
# output where people sit
panel_12 = Panel("1 to 11")  # disabled
# occupant count 0-10
panel_13 = Panel("1")  # disabled
random = Random(Range=panel_12, Number=panel_13, Seed=seed)  # disabled
panel_14 = Panel(random)  # disabled
integer = Integer(random)  # disabled
series = Series(Start=Slider(0, range=0..100), Step=1, Count=Slider(23, range=0..100))
panel_15 = Panel(integer)  # disabled
# occupant location 0-22
jitter = Jitter(List=series, Jitter=Slider(1, range=0..1), Seed=seed)  # -> Values, Indices
split_list = SplitList(List=jitter.Values, Index=number_slider_5)  # -> ListA, ListB

boolean_toggle_4 = BooleanToggle(True)
sky_2 = ConstructCSSky(
    Type="CIE_Clear",
    Weather="SGP_SG_Changi.Intl.AP.486980_TMYx.2004-2018",
    Month="3",
    Day="21",
    Hour="13",
    Input_0_Hidden=False,
    Input_0_Name="Type",
    Input_10_Hidden=True,
    Input_10_Name="Turbidity",
    Input_11_Hidden=True,
    Input_11_Name="Year",
    Input_12_Hidden=True,
    Input_12_Name="Condition",
    Input_1_Hidden=False,
    Input_1_Name="Weather",
    Input_2_Hidden=False,
    Input_2_Name="Month",
    Input_3_Hidden=False,
    Input_3_Name="Day",
    Input_4_Hidden=False,
    Input_4_Name="Hour",
    Input_5_Hidden=True,
    Input_5_Name="GHI",
    Input_6_Hidden=True,
    Input_6_Name="Direct",
    Input_7_Hidden=True,
    Input_7_Name="Diffuse",
    Input_8_Hidden=True,
    Input_8_Name="Ground Albedo",
    Input_9_Hidden=True,
    Input_9_Name="Ground Source",
    UnitSystem=4,
    Input_8_GHParam_Branch0_Path="{0}",
    Input_8_GHParam_Branch0_Item0_number=0.2,
    Input_9_GHParam_Branch0_Path="{0}",
    Input_9_GHParam_Branch0_Item0_boolean=True,
    Input_10_GHParam_Branch0_Path="{0}",
    Input_10_GHParam_Branch0_Item0_number=3,
    Input_11_GHParam_Branch0_Path="{0}",
    Input_11_GHParam_Branch0_Item0_number=2021,
    Input_12_GHParam_Branch0_Path="{0}",
    Input_12_GHParam_Branch0_Item0_null_string=False,
    Input_12_GHParam_Branch0_Item0_string="Clear")
panel_16 = Panel(sky_2)
sort_list = SortList(Keys=split_list.ListA)  # -> Keys, ValuesValuesA
seat_distribution_id = Slider(0, range=0..74)
panel_17 = Panel("C:\Users\e1583443\OneDrive\NUS\2025fall\ai\2025Sp_AI_Sustain_Project\ASIM\ASIM-simulation\office_occupancy_distributions_75.csv")
python_3_script_2 = Python3Script(path=panel_17, row_index=seat_distribution_id)  # -> out, seats
# ---------- python_3_script_2: Python ----------
import csv
import io
import os

seats = []

if path and os.path.isfile(path):
    try:
        with io.open(path, "r", encoding="utf-8-sig") as f:
            rows = list(csv.DictReader(f))

        index = int(row_index)

        if 0 <= index < len(rows):
            text = rows[index]["occupied_seats"]

            seats = [
                int(value)
                for value in text.split(";")
                if value.strip()
            ]

    except:
        seats = []
# ---------- end python_3_script_2 ----------
panel_18 = Panel(sort_list.Keys)
panel_19 = Panel(python_3_script_2.seats)
panel_20 = Panel("""8
9
10
11
12
13
14
15""")
panel_21 = Panel("""0
1
2
3
4
5
6
7""")
people_sit = Panel(panel_18)
panel_22 = Panel("""16
17
18
19
20
21
22
23""")

_15 = Slider(0, range=0..6)
_17 = Slider(3, range=0..6)
_18 = Slider(3, range=0..6)
_19 = Slider(3, range=0..6)
_20 = Slider(0, range=0..6)
_21 = Slider(0, range=0..6)
_1 = Slider(0, range=0..6)
_9 = Slider(0, range=0..6)
_12 = Slider(0, range=0..6)
_13 = Slider(0, range=0..6)
_14 = Slider(0, range=0..6)
_16 = Slider(3, range=0..6)
_3 = Slider(0, range=0..6)
_5 = Slider(0, range=0..6)
_6 = Slider(0, range=0..6)
_7 = Slider(0, range=0..6)
_8 = Slider(0, range=0..6)
_11 = Slider(0, range=0..6)
# Decision variables
_0 = Slider(0, range=0..6)
_2 = Slider(0, range=0..6)
_4 = Slider(0, range=0..6)
_10 = Slider(0, range=0..6)
_22 = Slider(0, range=0..6)
# 24盏桌面灯光强控制
# 7 light class choice for task light (0-6) start with no light
_23 = Slider(0, range=0..6)

number_slider_6 = Slider(0, range=0..8)
# 三排顶灯光强控制
number_slider_7 = Slider(0, range=0..8)
number_slider_8 = Slider(0, range=0..8)

mass_addition = MassAddition(Input=[number_slider_8, number_slider_6, number_slider_7])  # -> Result, PartialResults
# Environmental inputs
merge = Merge(
    Data1=_0,
    Data2=_1,
    Data3=_2,
    Data4=_3,
    Data5=_4,
    Data6=_5,
    Data7=_6,
    Data8=_7,
    Data9=_8,
    Data10=_9,
    Data11=_10,
    Data12=_11,
    Data13=_12,
    Data14=_13,
    Data15=_14,
    Data16=_15,
    Data17=_16,
    Data18=_17,
    Data19=_18,
    Data20=_19,
    Data21=_20,
    Data22=_21,
    Data23=_22,
    Data24=_23)
panel_23 = Panel(python_3_script_2.seats)
panel_24 = Panel(merge)

# ----
# 除去没人坐的,只计算人坐的位子开灯的效果
python_3_script_3 = Python3Script(x=merge, y=panel_23)  # -> out, a; inputs x: list of Int32, y: list of Int32
# ---------- python_3_script_3: Python ----------
result = 0

for i in y:
    result += x[i]

a = result
# ---------- end python_3_script_3 ----------
ceiling_light_full_load_power_2 = Panel("9")
division_2 = Division(A=ceiling_light_full_load_power_2, B=Slider(6, range=0..10))
multiplication = Multiplication(A=python_3_script_3.a, B=division_2)

mass_addition_2 = MassAddition(Input=merge)  # -> Result, PartialResults
panel_25 = Panel("C:\Users\e1583443\OneDrive\NUS\2025fall\ai\2025Sp_AI_Sustain_Project\ASIM-simulation\dataset_Overcast.xlsx")
run = Button()
galapagos = Galapagos(
    fitness=python_3_script_16,
    gene=[_0, _1, _2, _4, _15, number_slider_8, number_slider_7, number_slider_6, _10, _9, _11, _12, _5, _6, _8, _7, _3, _13, _14, _16, _17, _18, _19, _20, _21, _22, _23])

# ----
# control strategy of task light
# 4 class task light corresponding power (all using)
panel_26 = Panel("Linear 4' Direct (Flood) - 3900 lm - task - 6/6")
getcsluminaireproduct_12 = GetCSLuminaireProduct(SearchName="Linear 4' Direct (Flood) - 3900 lm - task - 4/6", UnitSystem=4)
getcsluminaireproduct_13 = GetCSLuminaireProduct(SearchName="Linear 4' Direct (Flood) - 3900 lm - task - 5/6", UnitSystem=4)
getcsluminaireproduct_14 = GetCSLuminaireProduct(SearchName="Linear 4' Direct (Flood) - 3900 lm - task - 3/6", UnitSystem=4)
getcsluminaireproduct_15 = GetCSLuminaireProduct(UnitSystem=4)
multiplication_2 = Multiplication(A=task_light_level, B=division)  # disabled
panel_27 = Panel(multiplication_2)  # disabled

getcsluminaireproduct_16 = GetCSLuminaireProduct(SearchName=panel_26, UnitSystem=4)

merge_2 = Merge(
    Data1=getcsluminaireproduct_3,
    Data2=getcsluminaireproduct,
    Data3=getcsluminaireproduct_2,
    Data4=getcsluminaireproduct_14,
    Data5=getcsluminaireproduct_12,
    Data6=getcsluminaireproduct_13,
    Data7=getcsluminaireproduct_16)
list_item_2 = ListItem(List=merge_2, Index=task_light_level, Wrap=True)

multiplication_3 = Multiplication(A=multiplication_2, B=integer)  # disabled
panel_28 = Panel(multiplication_3)  # disabled

# ----
# geometry setting
cs_unitscale = CSUnitScale(
    From="Meters",
    To="ActiveRhinoDocUnits",
    Listener=True,
    Input_0_Hidden=False,
    Input_0_Name="From",
    Input_1_Hidden=False,
    Input_1_Name="To",
    Input_2_Hidden=False,
    Input_2_Name="Listener",
    UnitSystem=4)
F = Number(cs_unitscale)
ceiling_3 = Brep(<brep referenced from the Rhino model>)
ceiling_4 = Brep([<brep referenced from the Rhino model> x72])
ceiling_5 = Brep([<brep referenced from the Rhino model> x24])
mullion = Brep([<brep referenced from the Rhino model> x72])
glazing = Brep([<brep referenced from the Rhino model> x12])
floor = Brep([<brep referenced from the Rhino model> x8])
wall = Brep([<brep referenced from the Rhino model> x6])
scale = Scale(Geometry=ceiling_4, Center=Point(0, 0, 0), Factor=F)  # -> Geometry, Transform
scale_2 = Scale(Geometry=ceiling_3, Center=Point(0, 0, 0), Factor=F)  # -> Geometry, Transform
scale_3 = Scale(Geometry=floor, Center=Point(0, 0, 0), Factor=F)  # -> Geometry, Transform
scale_4 = Scale(Geometry=mullion, Center=Point(0, 0, 0), Factor=F)  # -> Geometry, Transform
scale_5 = Scale(Geometry=wall, Center=Point(0, 0, 0), Factor=F)  # -> Geometry, Transform
scale_6 = Scale(Geometry=glazing, Center=Point(0, 0, 0), Factor=F)  # -> Geometry, Transform
scale_7 = Scale(Geometry=ceiling_5, Center=Point(0, 0, 0), Factor=F)  # -> Geometry, Transform
floor_2 = Brep(scale_3.Geometry)
wall_2 = Brep(scale_5.Geometry)
ceiling_6 = Brep(scale_2.Geometry)
glazing_2 = Brep(scale_6.Geometry)
mullion_2 = Brep(scale_4.Geometry)
ceiling_7 = Brep(scale.Geometry)
ceiling_8 = Brep(scale_7.Geometry)
get_cs_lightingmaterial_3 = GetCSLightingMaterial(UnitSystem=4)
get_cs_lightingmaterial_4 = GetCSLightingMaterial(Search="ceiling lm83", UnitSystem=4)
get_cs_lightingmaterial_5 = GetCSLightingMaterial(Search="floor lm83", UnitSystem=4)
get_cs_lightingmaterial_6 = GetCSLightingMaterial(UnitSystem=4)
get_cs_lightingmaterial_7 = GetCSLightingMaterial(Search="wall lm83", UnitSystem=4)
get_cs_lightingmaterial_8 = GetCSLightingMaterial(UnitSystem=4)
get_cs_lightingmaterial_9 = GetCSLightingMaterial(Search="White Table Top", UnitSystem=4)
construct_cs_scenelayer = ConstructCSSceneLayer(
    Name="monitor",
    Material=get_cs_lightingmaterial_3,
    Geometry=ceiling_7,
    Input_0_Hidden=False,
    Input_0_Name="Name",
    Input_1_Hidden=False,
    Input_1_Name="Material",
    Input_2_Hidden=False,
    Input_2_Name="Geometry",
    Input_3_Hidden=True,
    Input_3_Name="ViewTag",
    UnitSystem=4,
    Input_3_GHParam_Branch0_Path="{0}",
    Input_3_GHParam_Branch0_Item0_null_string=False,
    Input_3_GHParam_Branch0_Item0_string="None")
construct_cs_scenelayer_2 = ConstructCSSceneLayer(
    Name="CEILING",
    Material=get_cs_lightingmaterial_4,
    Geometry=ceiling_6,
    Input_0_Hidden=False,
    Input_0_Name="Name",
    Input_1_Hidden=False,
    Input_1_Name="Material",
    Input_2_Hidden=False,
    Input_2_Name="Geometry",
    Input_3_Hidden=True,
    Input_3_Name="ViewTag",
    UnitSystem=4,
    Input_3_GHParam_Branch0_Path="{0}",
    Input_3_GHParam_Branch0_Item0_null_string=False,
    Input_3_GHParam_Branch0_Item0_string="None")
construct_cs_scenelayer_3 = ConstructCSSceneLayer(
    Name="FLOOR",
    Material=get_cs_lightingmaterial_5,
    Geometry=floor_2,
    Input_0_Hidden=False,
    Input_0_Name="Name",
    Input_1_Hidden=False,
    Input_1_Name="Material",
    Input_2_Hidden=False,
    Input_2_Name="Geometry",
    Input_3_Hidden=True,
    Input_3_Name="ViewTag",
    UnitSystem=4,
    Input_3_GHParam_Branch0_Path="{0}",
    Input_3_GHParam_Branch0_Item0_null_string=False,
    Input_3_GHParam_Branch0_Item0_string="None")
construct_cs_scenelayer_4 = ConstructCSSceneLayer(
    Name="MULLION",
    Material=get_cs_lightingmaterial_6,
    Geometry=mullion_2,
    Input_0_Hidden=False,
    Input_0_Name="Name",
    Input_1_Hidden=False,
    Input_1_Name="Material",
    Input_2_Hidden=False,
    Input_2_Name="Geometry",
    Input_3_Hidden=True,
    Input_3_Name="ViewTag",
    UnitSystem=4,
    Input_3_GHParam_Branch0_Path="{0}",
    Input_3_GHParam_Branch0_Item0_null_string=False,
    Input_3_GHParam_Branch0_Item0_string="None")
construct_cs_scenelayer_5 = ConstructCSSceneLayer(
    Name="WALL",
    Material=get_cs_lightingmaterial_7,
    Geometry=wall_2,
    Input_0_Hidden=False,
    Input_0_Name="Name",
    Input_1_Hidden=False,
    Input_1_Name="Material",
    Input_2_Hidden=False,
    Input_2_Name="Geometry",
    Input_3_Hidden=True,
    Input_3_Name="ViewTag",
    UnitSystem=4,
    Input_3_GHParam_Branch0_Path="{0}",
    Input_3_GHParam_Branch0_Item0_null_string=False,
    Input_3_GHParam_Branch0_Item0_string="None")
construct_cs_scenelayer_6 = ConstructCSSceneLayer(
    Name="GLAZING",
    Material=get_cs_lightingmaterial_8,
    Geometry=glazing_2,
    Input_0_Hidden=False,
    Input_0_Name="Name",
    Input_1_Hidden=False,
    Input_1_Name="Material",
    Input_2_Hidden=False,
    Input_2_Name="Geometry",
    Input_3_Hidden=True,
    Input_3_Name="ViewTag",
    UnitSystem=4,
    Input_3_GHParam_Branch0_Path="{0}",
    Input_3_GHParam_Branch0_Item0_null_string=False,
    Input_3_GHParam_Branch0_Item0_string="None")
construct_cs_scenelayer_7 = ConstructCSSceneLayer(
    Name="TABLE",
    Material=get_cs_lightingmaterial_9,
    Geometry=ceiling_8,
    Input_0_Hidden=False,
    Input_0_Name="Name",
    Input_1_Hidden=False,
    Input_1_Name="Material",
    Input_2_Hidden=False,
    Input_2_Name="Geometry",
    Input_3_Hidden=True,
    Input_3_Name="ViewTag",
    UnitSystem=4,
    Input_3_GHParam_Branch0_Path="{0}",
    Input_3_GHParam_Branch0_Item0_null_string=False,
    Input_3_GHParam_Branch0_Item0_string="None")

# ----
# ceiling lights position
number_slider_9 = Slider(3, range=0..10)  # disabled
number_slider_10 = Slider(8, range=0..10)  # disabled
surface = Surface(<surface referenced from the Rhino model>)  # disabled
divide_surface = DivideSurface(Surface=surface, UCount=number_slider_9, VCount=number_slider_10)  # -> flatten(Points), Normals, Parameters; disabled
scale_8 = Scale(Geometry=divide_surface.Points, Center=Point(0, 0, 0), Factor=F)  # -> Geometry, Transform; disabled
point_list_2 = PointList(Points=scale_8.Geometry)  # disabled
lightpos = Point(scale_8.Geometry)  # disabled
panel_29 = Panel("""16
17
25
26
34
35""")  # disabled
number_slider_11 = Slider(0, range=0..100)  # disabled
xy_plane = XYPlane(Origin=Point(0, 0, 0))  # disabled
cull_index = CullIndex(List=lightpos, Indices=panel_29, Wrap=True)  # disabled
rotate = Rotate(Geometry=xy_plane, Angle=degrees(number_slider_11), Plane=PlaneXY(0, 0, 0))  # -> Geometry, Transform; disabled
number_slider_12 = Slider(2.6, range=0..10)  # disabled
number_slider_13 = Slider(0.55, range=0..1)  # disabled
plane_origin = PlaneOrigin(Base=rotate.Geometry, Origin=cull_index)  # disabled
vector_xyz_2 = VectorXYZ(XComponent=number_slider_13, YComponent=0, ZComponent=number_slider_12)  # -> Vector, Length; disabled
move_2 = Move(Geometry=plane_origin, Motion=vector_xyz_2.Vector)  # -> Geometry, Transform; disabled

# ----
# surrounding areas
number_slider_14 = Slider(2, range=0..10)
deconstruct_brep = DeconstructBrep(Brep=ceiling_8)  # -> Faces, Edges, Vertices
list_item_3 = ListItem(List=deconstruct_brep.Edges, Index=number_slider_14, Wrap=True)
curve_middle_2 = CurveMiddle(Curve=list_item_3)  # -> flatten(Midpoint)
# seats number
number_slider_15 = Slider(1, range=0..10)  # disabled
evaluate_curve = EvaluateCurve(Curve=reparameterize(flatten(list_item_3)), Parameter=flatten("0.5"))  # -> Point, Tangent, Angle
point_list_3 = PointList(Points=curve_middle_2, Size=number_slider_15)  # disabled
vector_display = VectorDisplay(Anchor=curve_middle_2, Vector=evaluate_curve.Tangent)  # disabled
rotate_2 = Rotate(Geometry=evaluate_curve.Tangent, Angle=degrees("-90"), Plane=PlaneXY(0, 0, 0))  # -> Geometry, Transform
vector_display_2 = VectorDisplay(Anchor=curve_middle_2, Vector=rotate_2.Geometry)  # disabled
number_slider_16 = Slider(0.7, range=0..1)
panel_30 = Panel("-0.5")
center_box = CenterBox(Base=curve_middle_2, X=Slider(1, range=0..1), Y=Slider(0.5, range=0..1), Z=Slider(0, range=0..100))  # -> graft(Box)
multiplication_4 = Multiplication(A=rotate_2.Geometry, B="-0.5")
multiplication_5 = Multiplication(A=evaluate_curve.Tangent, B="-0.5", C=number_slider_16)
line_sdl = LineSDL(Start=curve_middle_2, Direction=evaluate_curve.Tangent, Length=number_slider_16)
deconstruct_brep_2 = DeconstructBrep(Brep=center_box)  # -> Faces, Edges, Vertices
line_sdl_2 = LineSDL(Start=curve_middle_2, Direction=multiplication_4, Length=multiplication_4)  # -> graft(Line)
move_3 = Move(Geometry=line_sdl, Motion=multiplication_5)  # -> graft(Geometry), Transform
# task areas
sweep1 = Sweep1(Rail=line_sdl_2, Sections=move_3.Geometry, Miter=1)  # -> flatten(Brep)
list_item_4 = ListItem(List=deconstruct_brep_2.Faces, Index=Slider(5, range=0..10), Wrap=True)  # -> flatten(Item)
region_difference = RegionDifference(CurvesA=graft(list_item_4), CurvesB=graft(sweep1))  # -> flatten(Result)

scale_9 = Scale(Geometry=ceiling, Center=Point(0, 0, 0), Factor=F)  # -> Geometry, Transform

# ----
# task lights position
number_slider_17 = Slider(1, range=0..10)
deconstruct_brep_3 = DeconstructBrep(Brep=graft(sweep1))  # -> Faces, Edges, Vertices
list_item_5 = ListItem(List=deconstruct_brep_3.Edges, Index=number_slider_17, Wrap=True)
unit_z = UnitZ(Factor=Slider(0.5, range=0..1))
curve_middle_3 = CurveMiddle(Curve=list_item_5)
move_4 = Move(Geometry=curve_middle_3, Motion=unit_z)  # -> flatten(Geometry), Transform
# task light where occpant seats
# 人坐的位置
place_cs_luminaire = PlaceCSLuminaire(
    LuminaireProduct=list_item_2,
    Plane=move_4.Geometry,
    WebSize=1,
    Output_0_Hidden=False,
    Output_0_Name="Luminaire",
    Output_1_Hidden=True,
    Output_1_Name="Lumens",
    UnitSystem=4,
    showArrow=True,
    showH=False,
    showV=True,
    showWireframe=True)  # disabled

ceiling_9 = Brep(scale_9.Geometry)
point_list_4 = PointList(Points=move_4.Geometry, Size=Slider(0.4, range=0..1))
scale_10 = Scale(Geometry=ceiling_2, Center=Point(0, 0, 0), Factor=F)  # -> Geometry, Transform

# ----
# light analysis plan
grid_2 = Brep(<brep referenced from the Rhino model>)
scale_11 = Scale(Geometry=grid, Center=Point(0, 0, 0), Factor=F)  # -> Geometry, Transform
grid_3 = Brep(scale_11.Geometry)
construct_cs_sensorgrid = ConstructCSSensorGrid(
    Level="LEVEL 01",
    Id="101",
    Description="Open office",
    Geometry=grid_3,
    Spacing=Slider(0.2, range=0..1),
    Input_0_Hidden=True,
    Input_0_Name="Building",
    Input_10_Hidden=True,
    Input_10_Name="SupplementalLux",
    Input_11_Hidden=True,
    Input_11_Name="TargetLux",
    Input_12_Hidden=True,
    Input_12_Name="ExcessiveLux",
    Input_13_Hidden=True,
    Input_13_Name="sDA_Time",
    Input_14_Hidden=True,
    Input_14_Name="BREEAMSpaceType",
    Input_15_Hidden=True,
    Input_15_Name="ViewOffset",
    Input_16_Hidden=True,
    Input_16_Name="ViewDirections",
    Input_17_Hidden=True,
    Input_17_Name="ViewRotation",
    Input_18_Hidden=True,
    Input_18_Name="Points Override",
    Input_19_Hidden=True,
    Input_19_Name="Normals Override",
    Input_1_Hidden=False,
    Input_1_Name="Level",
    Input_20_Hidden=True,
    Input_20_Name="Disk Radius",
    Input_21_Hidden=True,
    Input_21_Name="Max Radius",
    Input_22_Hidden=True,
    Input_22_Name="Normal Override"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)

glazing_3 = Brep(scale_10.Geometry)
construct_cs_scenelayer_8 = ConstructCSSceneLayer(
    Name="CEILING",
    Material=get_cs_lightingmaterial,
    Geometry=ceiling_9,
    Input_0_Hidden=False,
    Input_0_Name="Name",
    Input_1_Hidden=False,
    Input_1_Name="Material",
    Input_2_Hidden=False,
    Input_2_Name="Geometry",
    Input_3_Hidden=True,
    Input_3_Name="ViewTag",
    UnitSystem=4,
    Input_3_GHParam_Branch0_Path="{0}",
    Input_3_GHParam_Branch0_Item0_null_string=False,
    Input_3_GHParam_Branch0_Item0_string="None")
construct_cs_scenelayer_9 = ConstructCSSceneLayer(
    Name="GLAZING",
    Material=get_cs_lightingmaterial_2,
    Geometry=glazing_3,
    Input_0_Hidden=False,
    Input_0_Name="Name",
    Input_1_Hidden=False,
    Input_1_Name="Material",
    Input_2_Hidden=False,
    Input_2_Name="Geometry",
    Input_3_Hidden=True,
    Input_3_Name="ViewTag",
    UnitSystem=4,
    Input_3_GHParam_Branch0_Path="{0}",
    Input_3_GHParam_Branch0_Item0_null_string=False,
    Input_3_GHParam_Branch0_Item0_string="None")

data = Data(flatten([construct_cs_scenelayer, construct_cs_scenelayer_7, construct_cs_scenelayer_2, construct_cs_scenelayer_3, construct_cs_scenelayer_4, construct_cs_scenelayer_5, construct_cs_scenelayer_6, construct_cs_scenelayer_8, construct_cs_scenelayer_9]))

# ----
# random occupant task
# and surrounding areas
list_item_6 = ListItem(List=sweep1, Index=panel_23, Wrap=True)  # -> graft(Item)
list_item_7 = ListItem(List=region_difference, Index=panel_23, Wrap=True)  # -> graft(Item)

area = Area(Geometry=region_difference)  # -> Area, Centroid
point_list_5 = PointList(Points=area.Centroid, Size=Slider(0.4, range=0..1))
# 9 light class choice for task light (0-8) start with no light
list_item_8 = ListItem(List=move_4.Geometry, Index=python_3_script_2.seats, Wrap=True)  # -> flatten(Item)

# ----
# 输出到对应的灯具选项
# 应该亮灯的位子(人坐的)
# 这样人坐的task灯才会亮
# 按顺序的灯位置
# 只有人坐的位子的灯光才会开
explode_tree_2 = ExplodeTree(Data=graft(move_4.Geometry))  # -> Branch0, Branch1, Branch2, Branch3, Branch4, Branch5, Branch6, Branch7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
stream_gate = StreamGate(Stream=explode_tree_2.Branch11, Gate=_11)  # -> Target0, Target1, Target2, Target3, Target4, Target5, Target6
stream_gate_2 = StreamGate(Stream=explode_tree_2.Branch14, Gate=_14)  # -> Target0, Target1, Target2, Target3, Target4, Target5, Target6
stream_gate_3 = StreamGate(Stream=explode_tree_2.Branch6, Gate=_6)  # -> Target0, Target1, Target2, Target3, Target4, Target5, Target6
stream_gate_4 = StreamGate(Stream=explode_tree_2.Branch12, Gate=_12)  # -> Target0, Target1, Target2, Target3, Target4, Target5, Target6
stream_gate_5 = StreamGate(Stream=explode_tree_2.Branch10, Gate=_10)  # -> Target0, Target1, Target2, Target3, Target4, Target5, Target6
stream_gate_6 = StreamGate(Stream=explode_tree_2.Branch9, Gate=_9)  # -> Target0, Target1, Target2, Target3, Target4, Target5, Target6
stream_gate_7 = StreamGate(Stream=explode_tree_2.Branch1, Gate=_1)  # -> Target0, Target1, Target2, Target3, Target4, Target5, Target6
stream_gate_8 = StreamGate(Stream=explode_tree_2.Branch7, Gate=_7)  # -> Target0, Target1, Target2, Target3, Target4, Target5, Target6
stream_gate_9 = StreamGate(Stream=explode_tree_2.Branch13, Gate=_13)  # -> Target0, Target1, Target2, Target3, Target4, Target5, Target6
stream_gate_10 = StreamGate(Stream=explode_tree_2.Branch5, Gate=_5)  # -> Target0, Target1, Target2, Target3, Target4, Target5, Target6
stream_gate_11 = StreamGate(Stream=explode_tree_2.Branch4, Gate=_4)  # -> Target0, Target1, Target2, Target3, Target4, Target5, Target6
stream_gate_12 = StreamGate(Stream=explode_tree_2.Branch2, Gate=_2)  # -> Target0, Target1, Target2, Target3, Target4, Target5, Target6
stream_gate_13 = StreamGate(Stream=explode_tree_2.Branch8, Gate=_8)  # -> Target0, Target1, Target2, Target3, Target4, Target5, Target6
stream_gate_14 = StreamGate(Stream=explode_tree_2.Branch0, Gate=_0)  # -> Target0, Target1, Target2, Target3, Target4, Target5, Target6
stream_gate_15 = StreamGate(Stream=explode_tree_2.Branch3, Gate=_3)  # -> Target0, Target1, Target2, Target3, Target4, Target5, Target6
point_4 = Point(list_item_8)
stream_gate_16 = StreamGate(Stream=explode_tree_2.Branch15, Gate=_15)  # -> Target0, Target1, Target2, Target3, Target4, Target5, Target6
stream_gate_17 = StreamGate(Stream=explode_tree_2.Branch16, Gate=_16)  # -> Target0, Target1, Target2, Target3, Target4, Target5, Target6
stream_gate_18 = StreamGate(Stream=explode_tree_2.Branch19, Gate=_19)  # -> Target0, Target1, Target2, Target3, Target4, Target5, Target6
stream_gate_19 = StreamGate(Stream=explode_tree_2.Branch17, Gate=_17)  # -> Target0, Target1, Target2, Target3, Target4, Target5, Target6
stream_gate_20 = StreamGate(Stream=explode_tree_2.Branch18, Gate=_18)  # -> Target0, Target1, Target2, Target3, Target4, Target5, Target6
sphere = Sphere(Base=point_4, Radius=Slider(0.4, range=0..1))
stream_gate_21 = StreamGate(Stream=explode_tree_2.Branch23, Gate=_23)  # -> Target0, Target1, Target2, Target3, Target4, Target5, Target6
stream_gate_22 = StreamGate(Stream=explode_tree_2.Branch22, Gate=_22)  # -> Target0, Target1, Target2, Target3, Target4, Target5, Target6
stream_gate_23 = StreamGate(Stream=explode_tree_2.Branch20, Gate=_20)  # -> Target0, Target1, Target2, Target3, Target4, Target5, Target6
stream_gate_24 = StreamGate(Stream=explode_tree_2.Branch21, Gate=_21)  # -> Target0, Target1, Target2, Target3, Target4, Target5, Target6
merge_3 = Merge(Data1=[stream_gate_14.Target0, stream_gate_7.Target0, stream_gate_12.Target0, stream_gate_15.Target0, stream_gate_11.Target0, stream_gate_10.Target0, stream_gate_3.Target0, stream_gate_8.Target0, stream_gate_13.Target0, stream_gate_6.Target0, stream_gate_5.Target0, stream_gate.Target0, stream_gate_4.Target0, stream_gate_9.Target0, stream_gate_2.Target0, stream_gate_16.Target0, stream_gate_17.Target0, stream_gate_19.Target0, stream_gate_20.Target0, stream_gate_18.Target0, stream_gate_23.Target0, stream_gate_24.Target0, stream_gate_22.Target0, stream_gate_21.Target0])  # -> flatten(Result)
merge_4 = Merge(Data1=[stream_gate_14.Target2, stream_gate_7.Target2, stream_gate_12.Target2, stream_gate_15.Target2, stream_gate_11.Target2, stream_gate_10.Target2, stream_gate_3.Target2, stream_gate_8.Target2, stream_gate_13.Target2, stream_gate_6.Target2, stream_gate_5.Target2, stream_gate.Target2, stream_gate_4.Target2, stream_gate_9.Target2, stream_gate_2.Target2, stream_gate_16.Target2, stream_gate_17.Target2, stream_gate_19.Target2, stream_gate_20.Target2, stream_gate_18.Target2, stream_gate_23.Target2, stream_gate_24.Target2, stream_gate_22.Target2, stream_gate_21.Target2])  # -> flatten(Result)
merge_5 = Merge(Data1=[stream_gate_14.Target1, stream_gate_7.Target1, stream_gate_12.Target1, stream_gate_15.Target1, stream_gate_11.Target1, stream_gate_10.Target1, stream_gate_3.Target1, stream_gate_8.Target1, stream_gate_13.Target1, stream_gate_6.Target1, stream_gate_5.Target1, stream_gate.Target1, stream_gate_4.Target1, stream_gate_9.Target1, stream_gate_2.Target1, stream_gate_16.Target1, stream_gate_17.Target1, stream_gate_19.Target1, stream_gate_20.Target1, stream_gate_18.Target1, stream_gate_23.Target1, stream_gate_24.Target1, stream_gate_22.Target1, stream_gate_21.Target1])  # -> flatten(Result)
merge_6 = Merge(Data1=[stream_gate_14.Target6, stream_gate_7.Target6, stream_gate_12.Target6, stream_gate_15.Target6, stream_gate_11.Target6, stream_gate_10.Target6, stream_gate_3.Target6, stream_gate_8.Target6, stream_gate_13.Target6, stream_gate_6.Target6, stream_gate_5.Target6, stream_gate.Target6, stream_gate_4.Target6, stream_gate_9.Target6, stream_gate_2.Target6, stream_gate_16.Target6, stream_gate_17.Target6, stream_gate_19.Target6, stream_gate_20.Target6, stream_gate_18.Target6, stream_gate_23.Target6, stream_gate_24.Target6, stream_gate_22.Target6, stream_gate_21.Target6])  # -> flatten(Result)
merge_7 = Merge(Data1=[stream_gate_14.Target3, stream_gate_7.Target3, stream_gate_12.Target3, stream_gate_15.Target3, stream_gate_11.Target3, stream_gate_10.Target3, stream_gate_3.Target3, stream_gate_8.Target3, stream_gate_13.Target3, stream_gate_6.Target3, stream_gate_5.Target3, stream_gate.Target3, stream_gate_4.Target3, stream_gate_9.Target3, stream_gate_2.Target3, stream_gate_16.Target3, stream_gate_17.Target3, stream_gate_19.Target3, stream_gate_20.Target3, stream_gate_18.Target3, stream_gate_23.Target3, stream_gate_24.Target3, stream_gate_22.Target3, stream_gate_21.Target3])  # -> flatten(Result)
merge_8 = Merge(Data1=[stream_gate_14.Target5, stream_gate_7.Target5, stream_gate_12.Target5, stream_gate_15.Target5, stream_gate_11.Target5, stream_gate_10.Target5, stream_gate_3.Target5, stream_gate_8.Target5, stream_gate_13.Target5, stream_gate_6.Target5, stream_gate_5.Target5, stream_gate.Target5, stream_gate_4.Target5, stream_gate_9.Target5, stream_gate_2.Target5, stream_gate_16.Target5, stream_gate_17.Target5, stream_gate_19.Target5, stream_gate_20.Target5, stream_gate_18.Target5, stream_gate_23.Target5, stream_gate_24.Target5, stream_gate_22.Target5, stream_gate_21.Target5])  # -> flatten(Result)
merge_9 = Merge(Data1=[stream_gate_14.Target4, stream_gate_7.Target4, stream_gate_12.Target4, stream_gate_15.Target4, stream_gate_11.Target4, stream_gate_10.Target4, stream_gate_3.Target4, stream_gate_8.Target4, stream_gate_13.Target4, stream_gate_6.Target4, stream_gate_5.Target4, stream_gate.Target4, stream_gate_4.Target4, stream_gate_9.Target4, stream_gate_2.Target4, stream_gate_16.Target4, stream_gate_17.Target4, stream_gate_19.Target4, stream_gate_20.Target4, stream_gate_18.Target4, stream_gate_23.Target4, stream_gate_24.Target4, stream_gate_22.Target4, stream_gate_21.Target4])  # -> flatten(Result)
python_3_script_4 = Python3Script(input_points=merge_5, occupancy_seats=point_4)  # -> out, a; inputs input_points: list of Point3d, occupancy_seats: list of Point3d
# ---------- python_3_script_4: Python ----------
# 输入: input_points, occupancy_seats
# 输出: result

import Rhino.Geometry as rg

tol = 1e-6  # 容差，可根据模型比例调整
result = []

if input_points:
    for pt in input_points:
        for seat in occupancy_seats:
            if pt.DistanceTo(seat) < tol:
                result.append(pt)
                # break  # 一旦找到匹配就跳出内层循环

a = result
# ---------- end python_3_script_4 ----------
python_3_script_5 = Python3Script(input_points=merge_6, occupancy_seats=point_4)  # -> out, a; inputs input_points: list of Point3d, occupancy_seats: list of Point3d; same code as python_3_script_4
python_3_script_6 = Python3Script(input_points=merge_3, occupancy_seats=point_4)  # -> out, a; inputs input_points: list of Point3d, occupancy_seats: list of Point3d; same code as python_3_script_4
python_3_script_7 = Python3Script(input_points=merge_7, occupancy_seats=point_4)  # -> out, a; inputs input_points: list of Point3d, occupancy_seats: list of Point3d; same code as python_3_script_4
python_3_script_8 = Python3Script(input_points=merge_9, occupancy_seats=point_4)  # -> out, a; inputs input_points: list of Point3d, occupancy_seats: list of Point3d; same code as python_3_script_4
python_3_script_9 = Python3Script(input_points=merge_4, occupancy_seats=point_4)  # -> out, a; inputs input_points: list of Point3d, occupancy_seats: list of Point3d; same code as python_3_script_4
python_3_script_10 = Python3Script(input_points=merge_8, occupancy_seats=point_4)  # -> out, a; inputs input_points: list of Point3d, occupancy_seats: list of Point3d; same code as python_3_script_4
point_5 = Point(python_3_script_8.a)
point_6 = Point(python_3_script_10.a)
point_7 = Point(python_3_script_4.a)
point_8 = Point(python_3_script_7.a)
point_9 = Point(python_3_script_9.a)
point_10 = Point(python_3_script_6.a)
point_11 = Point(python_3_script_5.a)

# ----
# 不同灯亮度的组 0-6
explode_tree_3 = ExplodeTree(Data=graft(merge_2))  # -> Branch0, Branch1, Branch2, Branch3, Branch4, Branch5, Branch6
place_cs_luminaire_2 = PlaceCSLuminaire(
    LuminaireProduct=explode_tree_3.Branch1,
    Plane=point_7,
    WebSize=1,
    Output_0_Hidden=False,
    Output_0_Name="Luminaire",
    Output_1_Hidden=True,
    Output_1_Name="Lumens",
    UnitSystem=4,
    showArrow=True,
    showH=False,
    showV=True,
    showWireframe=True)
place_cs_luminaire_3 = PlaceCSLuminaire(
    LuminaireProduct=explode_tree_3.Branch0,
    Plane=point_10,
    WebSize=1,
    Output_0_Hidden=False,
    Output_0_Name="Luminaire",
    Output_1_Hidden=True,
    Output_1_Name="Lumens",
    UnitSystem=4,
    showArrow=True,
    showH=False,
    showV=True,
    showWireframe=True)
place_cs_luminaire_4 = PlaceCSLuminaire(
    LuminaireProduct=explode_tree_3.Branch3,
    Plane=point_8,
    WebSize=1,
    Output_0_Hidden=False,
    Output_0_Name="Luminaire",
    Output_1_Hidden=True,
    Output_1_Name="Lumens",
    UnitSystem=4,
    showArrow=True,
    showH=False,
    showV=True,
    showWireframe=True)
place_cs_luminaire_5 = PlaceCSLuminaire(
    LuminaireProduct=explode_tree_3.Branch2,
    Plane=point_9,
    WebSize=1,
    Output_0_Hidden=False,
    Output_0_Name="Luminaire",
    Output_1_Hidden=True,
    Output_1_Name="Lumens",
    UnitSystem=4,
    showArrow=True,
    showH=False,
    showV=True,
    showWireframe=True)
place_cs_luminaire_6 = PlaceCSLuminaire(
    LuminaireProduct=explode_tree_3.Branch4,
    Plane=point_5,
    WebSize=1,
    Output_0_Hidden=False,
    Output_0_Name="Luminaire",
    Output_1_Hidden=True,
    Output_1_Name="Lumens",
    UnitSystem=4,
    showArrow=True,
    showH=False,
    showV=True,
    showWireframe=True)
place_cs_luminaire_7 = PlaceCSLuminaire(
    LuminaireProduct=explode_tree_3.Branch6,
    Plane=point_11,
    WebSize=1,
    Output_0_Hidden=False,
    Output_0_Name="Luminaire",
    Output_1_Hidden=True,
    Output_1_Name="Lumens",
    UnitSystem=4,
    showArrow=True,
    showH=False,
    showV=True,
    showWireframe=True)
place_cs_luminaire_8 = PlaceCSLuminaire(
    LuminaireProduct=explode_tree_3.Branch5,
    Plane=point_6,
    WebSize=1,
    Output_0_Hidden=False,
    Output_0_Name="Luminaire",
    Output_1_Hidden=True,
    Output_1_Name="Lumens",
    UnitSystem=4,
    showArrow=True,
    showH=False,
    showV=True,
    showWireframe=True)
merge_10 = Merge(
    Data1=place_cs_luminaire_3,
    Data2=place_cs_luminaire_2,
    Data3=place_cs_luminaire_5,
    Data4=place_cs_luminaire_4,
    Data5=place_cs_luminaire_6,
    Data6=place_cs_luminaire_8,
    Data7=place_cs_luminaire_7)  # -> flatten(Result)

getcsluminaireproduct_17 = GetCSLuminaireProduct(UnitSystem=4)
ceiling_light_full_load_power_3 = Panel("22")
# 4 class ceiling light corresponding power (all 30)
division_3 = Division(A=ceiling_light_full_load_power_3, B=Slider(5, range=0..10))
multiplication_6 = Multiplication(A=mass_addition.Result, B=division_3)
panel_31 = Panel(multiplication_6)

# ----
# control strategy of ceiling light
getcsluminaireproduct_18 = GetCSLuminaireProduct(SearchName="Linear 4' Direct (Flood) - 3900 lm - ceiling - 5/5", UnitSystem=4)

merge_11 = Merge(
    Data1=getcsluminaireproduct_5,
    Data2=getcsluminaireproduct_6,
    Data3=getcsluminaireproduct_7,
    Data4=getcsluminaireproduct_11,
    Data5=getcsluminaireproduct_10,
    Data6=getcsluminaireproduct_18,
    Data7=getcsluminaireproduct_4,
    Data8=getcsluminaireproduct_8,
    Data9=getcsluminaireproduct_9)
list_item_9 = ListItem(List=merge_11, Index=number_slider_8, Wrap=True)

list_item_10 = ListItem(List=merge_11, Index=number_slider_7, Wrap=True)
list_item_11 = ListItem(List=merge_11, Index=number_slider_6, Wrap=True)
multiplication_7 = Multiplication(A=multiplication_6, B="3")
panel_32 = Panel(multiplication_7)
place_cs_luminaire_9 = PlaceCSLuminaire(
    LuminaireProduct=list_item_9,
    Plane=move_2.Geometry,
    WebSize=1,
    Output_0_Hidden=False,
    Output_0_Name="Luminaire",
    Output_1_Hidden=True,
    Output_1_Name="Lumens",
    UnitSystem=4,
    showArrow=True,
    showH=False,
    showV=True,
    showWireframe=True)  # disabled

# ----
# lighting system merging
# ceiling light 012
place_cs_luminaire_10 = PlaceCSLuminaire(
    LuminaireProduct=list_item_9,
    Plane=point,
    WebSize=1,
    Output_0_Hidden=False,
    Output_0_Name="Luminaire",
    Output_1_Hidden=True,
    Output_1_Name="Lumens",
    UnitSystem=4,
    showArrow=True,
    showH=False,
    showV=True,
    showWireframe=True)
place_cs_luminaire_11 = PlaceCSLuminaire(
    LuminaireProduct=list_item_11,
    Plane=point_3,
    WebSize=1,
    Output_0_Hidden=False,
    Output_0_Name="Luminaire",
    Output_1_Hidden=True,
    Output_1_Name="Lumens",
    UnitSystem=4,
    showArrow=True,
    showH=False,
    showV=True,
    showWireframe=True)
place_cs_luminaire_12 = PlaceCSLuminaire(
    LuminaireProduct=list_item_10,
    Plane=point_2,
    WebSize=1,
    Output_0_Hidden=False,
    Output_0_Name="Luminaire",
    Output_1_Hidden=True,
    Output_1_Name="Lumens",
    UnitSystem=4,
    showArrow=True,
    showH=False,
    showV=True,
    showWireframe=True)
merge_12 = Merge(Data1=place_cs_luminaire_10, Data2=place_cs_luminaire_11, Data3=place_cs_luminaire_12, Data4=merge_10)  # -> flatten(Result)

panel_33 = Panel(place_cs_luminaire_10)

construct_cs_daylightmodel = ConstructCSDaylightModel(
    SceneLayers=data,
    Luminaires=merge_12,
    SensorGrids=construct_cs_sensorgrid,
    NorthOffset=0,
    Input_0_Hidden=False,
    Input_0_Name="SceneLayers",
    Input_1_Hidden=True,
    Input_1_Name="Windows",
    Input_2_Hidden=False,
    Input_2_Name="Luminaires",
    Input_3_Hidden=False,
    Input_3_Name="Tubular Devices",
    Input_4_Hidden=False,
    Input_4_Name="SensorGrids",
    Input_5_Hidden=False,
    Input_5_Name="Camera",
    Input_6_Hidden=False,
    Input_6_Name="North Offset",
    UnitSystem=4)
fc_max = Panel("750")
construct_domain = ConstructDomain(DomainStart=0, DomainEnd=fc_max)
get_cs_gradient = GetCSGradient(Steps=0, UnitSystem=4)
# simulation
run_cs_illuminance = RunCSIlluminance(
    Name="Simple Office\Electric Lighting",
    Model=construct_cs_daylightmodel,
    Sky=sky_2,
    Samples=4096,
    Run=run,
    Input_0_Hidden=False,
    Input_0_Name="Name",
    Input_10_Hidden=False,
    Input_10_Name="Run",
    Input_1_Hidden=False,
    Input_1_Name="Model",
    Input_2_Hidden=False,
    Input_2_Name="Sky",
    Input_3_Hidden=False,
    Input_3_Name="Samples",
    Input_4_Hidden=True,
    Input_4_Name="Threads",
    Input_5_Hidden=True,
    Input_5_Name="Radiance Params",
    Input_6_Hidden=True,
    Input_6_Name="Spectral",
    Input_7_Hidden=True,
    Input_7_Name="Ambient Bounces",
    Input_8_Hidden=True,
    Input_8_Name="Hide Pop-up",
    Input_9_Hidden=True,
    Input_9_Name="Weight Limit",
    UnitSystem=4,
    Input_4_GHParam_Branch0_Path="{0}",
    Input_4_GHParam_Branch0_Item0_number=0,
    Input_6_GHParam_Branch0_Path="{0}",
    Input_6_GHParam_Branch0_Item0_boolean=False,
    Input_7_GHParam_Branch0_Path="{0}",
    Input_7_GHParam_Branch0_Item0_number=6,
    Input_8_GHParam_Branch0_Path="{0}",
    Input_8_GHParam_Branch0_Item0_boolean=False,
    Input_9_GHParam_Branch0_Path="{0}",
    Input_9_GHParam_Branch0_Item0_number=0.01)
construct_cs_falsecolor = ConstructCSFalsecolor(GradientS=get_cs_gradient, DomainS=construct_domain, Log=False, Decades=3, UnitSystem=4)
load_cs_result = LoadCSResult(
    Result=run_cs_illuminance,
    Header=False,
    Output_0_Hidden=False,
    Output_0_Name="Name",
    Output_10_Hidden=True,
    Output_10_Name="Window Groups",
    Output_11_Hidden=True,
    Output_11_Name="Weather",
    Output_12_Hidden=True,
    Output_12_Name="North",
    Output_13_Hidden=True,
    Output_13_Name="LayerNames",
    Output_14_Hidden=True,
    Output_14_Name="LayerObjects",
    Output_15_Hidden=True,
    Output_15_Name="LayerMaterials",
    Output_16_Hidden=True,
    Output_16_Name="Sky",
    Output_1_Hidden=False,
    Output_1_Name="Type",
    Output_2_Hidden=True,
    Output_2_Name="Standard",
    Output_3_Hidden=True,
    Output_3_Name="Date",
    Output_4_Hidden=True,
    Output_4_Name="Version",
    Output_5_Hidden=True,
    Output_5_Name="FileSize",
    Output_6_Hidden=True,
    Output_6_Name="RunLog",
    Output_7_Hidden=False,
    Output_7_Name="Metrics",
    Output_8_Hidden=False,
    Output_8_Name="MetricValues",
    Output_9_Hidden=False,
    Output_9_Name="Grids",
    UnitSystem=4)  # -> Name, Type, Metrics, MetricValues, Grids
preview_cs_sensorgrid = PreviewCSSensorGrid(
    Grid=load_cs_result.Grids,
    Metric="Illuminance [lux]",
    Falsecolor=construct_cs_falsecolor,
    Input_0_Hidden=False,
    Input_0_Name="Grid",
    Input_1_Hidden=False,
    Input_1_Name="Metric",
    Input_2_Hidden=False,
    Input_2_Name="Falsecolor",
    Input_3_Hidden=True,
    Input_3_Name="Sensor Values",
    Input_4_Hidden=True,
    Input_4_Name="Show Points",
    Input_5_Hidden=True,
    Input_5_Name="Show Edges",
    Input_6_Hidden=True,
    Input_6_Name="Show Labels",
    Input_7_Hidden=True,
    Input_7_Name="Label Format",
    Input_8_Hidden=True,
    Input_8_Name="Transform",
    Input_9_Hidden=True,
    Input_9_Name="Max Radius",
    Output_0_Hidden=True,
    Output_0_Name="Mesh",
    Output_1_Hidden=True,
    Output_1_Name="Texture",
    UnitSystem=4,
    Input_4_GHParam_Branch0_Path="{0}",
    Input_4_GHParam_Branch0_Item0_boolean=True,
    Input_5_GHParam_Branch0_Path="{0}",
    Input_5_GHParam_Branch0_Item0_boolean=True,
    Input_6_GHParam_Branch0_Path="{0}",
    Input_6_GHParam_Branch0_Item0_boolean=False,
    Input_9_GHParam_Branch0_Path="{0}",
    Input_9_GHParam_Branch0_Item0_number=0)
list_length = ListLength(List=load_cs_result.Metrics)
duplicate_data = DuplicateData(Data="************************", Number=list_length, Order=True)
extract_cs_sensorgrid_data = ExtractCSSensorGridData(
    Grid=load_cs_result.Grids,
    Metric="Illuminance [lux]",
    Input_0_Hidden=False,
    Input_0_Name="Grid",
    Input_1_Hidden=False,
    Input_1_Name="Metric",
    UnitSystem=4)  # -> Metric, ValueS
deconstruct_cs_sensorgrid = DeconstructCSSensorGrid(
    Grid=load_cs_result.Grids,
    Output_0_Hidden=False,
    Output_0_Name="Building",
    Output_10_Hidden=True,
    Output_10_Name="Analysis Surface",
    Output_11_Hidden=True,
    Output_11_Name="Edges",
    Output_12_Hidden=True,
    Output_12_Name="View Points",
    Output_13_Hidden=True,
    Output_13_Name="Area",
    Output_14_Hidden=True,
    Output_14_Name="View Directions",
    Output_15_Hidden=False,
    Output_15_Name="Occupancy",
    Output_16_Hidden=True,
    Output_16_Name="View Wedges",
    Output_17_Hidden=True,
    Output_17_Name="Supplemental Lux",
    Output_18_Hidden=True,
    Output_18_Name="Target Lux",
    Output_19_Hidden=True,
    Output_19_Name="Excessive Lux",
    Output_1_Hidden=False,
    Output_1_Name="Level",
    Output_20_Hidden=True,
    Output_20_Name="Normal Override",
    Output_21_Hidden=True,
    Output_21_Name="Use Normal Override",
    Output_22_Hidden=True,
    Output_22_Name="Perimeter Edges"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)  # -> Building, Level, ID, SensorPoints, Occupancy
weave = Weave(
    Pattern=[0, 1, 2],
    Stream0=duplicate_data,
    Stream1=load_cs_result.Metrics,
    Stream2=load_cs_result.MetricValues,
    NullGaps=False)
metrics = Panel(weave)
panel_34 = Panel(extract_cs_sensorgrid_data.ValueS)  # disabled
text_tag = TextTag(Location=deconstruct_cs_sensorgrid.SensorPoints, Text=extract_cs_sensorgrid_data.ValueS)

# ----
# seems the lights are set in group
# more group makes it way slower
panel_35 = Panel(merge_12)
panel_36 = Panel(deconstruct_cs_sensorgrid.SensorPoints)

# ----
# Mean Illuminance of task area [lux]
# Each should > 500 lux
# Mean Illuminance of surrounding area [lux]
# Each should > 300 lux
# simulation button
unit_z_2 = UnitZ(Factor=1)
unit_z_3 = UnitZ(Factor=1)
extrude = Extrude(Base=list_item_7, Direction=unit_z_2)
extrude_2 = Extrude(Base=list_item_6, Direction=unit_z_3)
cap_holes = CapHoles(Brep=extrude)
point_in_brep = PointInBrep(Brep=extrude_2, Point=deconstruct_cs_sensorgrid.SensorPoints, Strict=False)
point_in_brep_2 = PointInBrep(Brep=cap_holes, Point=deconstruct_cs_sensorgrid.SensorPoints, Strict=False)
dispatch = Dispatch(List=deconstruct_cs_sensorgrid.SensorPoints, DispatchPattern=point_in_brep_2)  # -> ListA, ListB
dispatch_2 = Dispatch(List=deconstruct_cs_sensorgrid.SensorPoints, DispatchPattern=point_in_brep)  # -> ListA, ListB
dispatch_3 = Dispatch(List=extract_cs_sensorgrid_data.ValueS, DispatchPattern=point_in_brep_2)  # -> ListA, ListB
dispatch_4 = Dispatch(List=extract_cs_sensorgrid_data.ValueS, DispatchPattern=point_in_brep)  # -> ListA, ListB
point_12 = Point(dispatch.ListA)
point_13 = Point(dispatch_2.ListA)
param_viewer = ParamViewer(dispatch_4.ListA)

panel_37 = Panel(dispatch_4.ListA)
panel_38 = Panel(dispatch_3.ListA)

# ----
# Mean Illuminance of task area [lux]
# Each should > 750lux
# Mean Illuminance of surrounding area [lux]
# Each should > 500lux
average = Average(Input=dispatch_4.ListA)  # -> flatten(ArithmeticMean)
average_2 = Average(Input=dispatch_3.ListA)  # -> flatten(ArithmeticMean)

task_lu = Panel(average)
around_lu = Panel(average_2)

# ----
# 两个均匀度Task Uniformity > 0.7 (Emin/Eave)
# Surrounding Uniformity > 0.5 (Emin/Eave)
sort_list_2 = SortList(Keys=dispatch_3.ListA)  # -> Keys, ValuesValuesA
sort_list_3 = SortList(Keys=dispatch_4.ListA)  # -> Keys, ValuesValuesA
list_item_12 = ListItem(List=sort_list_2.Keys, Index=0, Wrap=True)
list_item_13 = ListItem(List=sort_list_3.Keys, Index=0, Wrap=True)
division_4 = Division(A=flatten(list_item_12), B=average_2)
division_5 = Division(A=flatten(list_item_13), B=average)

task_uni = Panel(division_5)
around_uni = Panel(division_4)
sort_list_4 = SortList(Keys=average_2)  # -> Keys, ValuesValuesA
sort_list_5 = SortList(Keys=average)  # -> Keys, ValuesValuesA
sort_list_6 = SortList(Keys=division_4)  # -> Keys, ValuesValuesA
sort_list_7 = SortList(Keys=division_5)  # -> Keys, ValuesValuesA
list_item_14 = ListItem(List=sort_list_5.Keys, Index=0, Wrap=True)
list_item_15 = ListItem(List=sort_list_7.Keys, Index=0, Wrap=True)
list_item_16 = ListItem(List=sort_list_4.Keys, Index=0, Wrap=True)
list_item_17 = ListItem(List=sort_list_6.Keys, Index=0, Wrap=True)
panel_39 = Panel(list_item_14)
panel_40 = Panel(list_item_16)
panel_41 = Panel(list_item_15)
panel_42 = Panel(list_item_17)
python_3_script_11 = Python3Script(x=list_item_14, y="750")  # -> out, a; inputs x: Double, y: Double
# ---------- python_3_script_11: Python ----------
"""Grasshopper Script"""
if y - x <= 0:
    a = 0
else:
    a = y - x

print(a)
# ---------- end python_3_script_11 ----------
# Objective variables
python_3_script_12 = Python3Script(x=list_item_16, y="500")  # -> out, a; inputs x: Double, y: Double; same code as python_3_script_11
python_3_script_13 = Python3Script(x=list_item_15, y="0.7")  # -> out, a; inputs x: Double, y: Double; same code as python_3_script_11
python_3_script_14 = Python3Script(x=list_item_17, y="0.5")  # -> out, a; inputs x: Double, y: Double; same code as python_3_script_11
panel_43 = Panel(python_3_script_13.out)

# ----
# 桌面光照优化算法之后,直接考虑值要minimize到0
number = Number(python_3_script_11.a)
number_2 = Number(python_3_script_12.a)

# ----
# 桌面光照优化算法之后,直接考虑值要minimize到0
number_3 = Number(python_3_script_13.a)
number_4 = Number(python_3_script_14.a)

# ----
# power in all
mass_addition_3 = MassAddition(Input=flatten([multiplication_7, multiplication]))  # -> Result, PartialResults

# ----
# 课上版本,选人数+分布方式,然后模拟(galapagos)到最佳解
power_all = Panel(mass_addition_3.Result)

# ----
# 导出结果into .csv
# 有人坐的位子,task light (人坐的才有数值),ceiling light
merge_13 = Merge(Data1=number_slider_8, Data2=number_slider_6, Data3=number_slider_7)
python_3_script_15 = Python3Script(
    task_lights=merge,
    ceiling_lights=merge_13,
    occupant=panel_23,
    power=mass_addition_3.Result,
    file_path=panel_25,
    write=Button(),
    append=Toggle(True))  # -> out, seats, task_lights, ceiling_lights, msg; inputs task_lights: list of Int32, ceiling_lights: list of Int32, occupant: list of Int32
# ---------- python_3_script_15: Python ----------
# GhPython (Python 3)
# Inputs: task_lights, ceiling_lights, occupant, file_path, write, append, power
# Outputs: seats, row_out, msg
# requirements: openpyxl

import os
import csv

TOTAL_SEATS = 24
CEIL_COLS = 3


def ensure_len(lst, n, fill=0):
    """将列表长度规范为 n，不足补 fill，超出截断。"""
    lst = list(lst) if lst is not None else []

    if len(lst) < n:
        return lst + [fill] * (n - len(lst))

    return lst[:n]


# ---------- 1) 计算座位占用 ----------
# seats：长度为 24 的 0/1 列表，供 Grasshopper 内部使用
# occupied_ids：有人占用的座位编号
seats = [0] * TOTAL_SEATS
occupied_ids = []

if occupant is None:
    occupant = []

for i in occupant:
    try:
        seat_id = int(i)
    except:
        continue

    if 0 <= seat_id < TOTAL_SEATS:
        # 避免重复 occupant ID
        if seats[seat_id] == 0:
            seats[seat_id] = 1
            occupied_ids.append(seat_id)

occupied_ids.sort()


# ---------- 2) 无人座位对应的 task light 置零 ----------
task_lights = ensure_len(task_lights, TOTAL_SEATS, 0)

for i in range(TOTAL_SEATS):
    if seats[i] == 0:
        task_lights[i] = 0


# ---------- 3) 规范 ceiling lights ----------
ceiling_lights = ensure_len(ceiling_lights, CEIL_COLS, 0)


# ---------- 4) 处理功率 ----------
try:
    pwr = float(power) if power is not None else 0.0
except:
    pwr = 0.0


# ---------- 5) 将 occupied seat ID 转为单元格字符串 ----------
# 示例：[1, 4, 8] -> "1;4;8"
seat_list = ";".join(str(i) for i in occupied_ids)

occupancy_count = len(occupied_ids)


# ---------- 6) 组装输出行 ----------
# occupancy_count + seat_list + 24 task + 3 ceiling + power
row_out = (
    [occupancy_count, seat_list]
    + list(task_lights)
    + list(ceiling_lights)
    + [pwr]
)


def make_header():
    header = [
        "occupancy_count",
        "seat_list"
    ]

    header += [
        "task_{:02d}".format(i)
        for i in range(TOTAL_SEATS)
    ]

    header += [
        "ceiling_{}".format(i + 1)
        for i in range(CEIL_COLS)
    ]

    header += ["power"]

    return header


# ---------- 7) 文件写入 ----------
msg = "ready"


def ensure_folder(file_path):
    folder = os.path.dirname(file_path)

    if folder and not os.path.exists(folder):
        os.makedirs(folder)


def write_csv(file_path, header, row, do_append):
    file_exists = os.path.exists(file_path)

    mode = "a" if do_append and file_exists else "w"

    with open(
        file_path,
        mode,
        newline="",
        encoding="utf-8-sig"
    ) as file:

        writer = csv.writer(file)

        if mode == "w":
            writer.writerow(header)

        writer.writerow(row)


def write_xlsx(file_path, header, row, do_append):
    try:
        import openpyxl
        from openpyxl import Workbook
        from openpyxl.styles import PatternFill

    except ImportError:
        return False, "openpyxl 不可用。"

    file_exists = os.path.exists(file_path)

    if do_append and file_exists:
        workbook = openpyxl.load_workbook(file_path)
        worksheet = workbook.active

    else:
        workbook = Workbook()
        worksheet = workbook.active
        worksheet.title = "Lighting Results"
        worksheet.append(header)

    # 写入当前结果
    worksheet.append(row)

    # 当前刚写入的行号
    current_row = worksheet.max_row

    # 红色填充
    red_fill = PatternFill(
        fill_type="solid",
        fgColor="FF0000"
    )

    # row 的结构：
    # 0 = occupancy_count
    # 1 = seat_list
    # 2–25 = 24 个 task lights
    # 26–28 = 3 个 ceiling lights
    # 29 = power

    task_start_index = 2
    task_end_index = task_start_index + TOTAL_SEATS

    ceiling_start_index = task_end_index
    ceiling_end_index = ceiling_start_index + CEIL_COLS

    # 检查 task light 和 ceiling light
    for row_index in range(task_start_index, ceiling_end_index):
        value = row[row_index]

        try:
            is_active = float(value) != 0
        except:
            is_active = value not in [None, "", 0, "0"]

        if is_active:
            # openpyxl 列编号从 1 开始，因此需要 +1
            excel_column = row_index + 1

            worksheet.cell(
                row=current_row,
                column=excel_column
            ).fill = red_fill

    workbook.save(file_path)

    return True, "写入 xlsx 成功，并已标红开启的灯具。"


# ---------- 8) 执行写入 ----------
if write:

    if not file_path or not isinstance(file_path, str):
        msg = "错误：file_path 为空或不是字符串。"

    else:
        try:
            ensure_folder(file_path)

            header = make_header()
            extension = os.path.splitext(file_path)[1].lower()

            if extension == ".csv":
                write_csv(
                    file_path,
                    header,
                    row_out,
                    append
                )

                msg = "写入 CSV 成功：{}".format(file_path)

            else:
                # 无扩展名时自动补充 .xlsx
                if extension == "":
                    file_path = file_path + ".xlsx"

                try:
                    success, note = write_xlsx(
                        file_path,
                        header,
                        row_out,
                        append
                    )

                    if success:
                        msg = "{} {}".format(note, file_path)

                    else:
                        csv_path = (
                            os.path.splitext(file_path)[0]
                            + ".csv"
                        )

                        write_csv(
                            csv_path,
                            header,
                            row_out,
                            append
                        )

                        msg = "{} 已回退为 CSV：{}".format(
                            note,
                            csv_path
                        )

                except Exception as error:
                    csv_path = (
                        os.path.splitext(file_path)[0]
                        + ".csv"
                    )

                    write_csv(
                        csv_path,
                        header,
                        row_out,
                        append
                    )

                    msg = (
                        "写入 xlsx 失败：{}；"
                        "已写入 CSV：{}"
                    ).format(error, csv_path)

        except Exception as error:
            msg = "写入失败：{}".format(error)

else:
    msg = "ready（未写入；write = False）"
# ---------- end python_3_script_15 ----------
panel_44 = Panel(python_3_script_15.msg)
panel_45 = Panel(python_3_script_15.seats)
panel_46 = Panel(python_3_script_15.task_lights)
panel_47 = Panel(python_3_script_15.ceiling_lights)

power = Panel(mass_addition_3.Result)
addition_2 = Addition(A=number_3, B=number_4)
addition_3 = Addition(A=number, B=number_2)
uniformitty = Number(addition_2)
illuminance = Number(addition_3)
energy = Number(mass_addition_3.Result)

# ----
# Galapagos
# 算上penalty的总和评估数值
# multi-optimize into single-optimize
python_3_script_16 = Python3Script(illu1=list_item_14, illu2=list_item_16, uni1=list_item_15, uni2=list_item_17, power=energy)  # -> out, a; inputs illu1: Double, illu2: Double, uni1: Double, uni2: Double, power: Double
# ---------- python_3_script_16: Python ----------
"""
Inputs (GhPython):
    illu1 : 测得照度1（希望 ≥ 500）
    illu0 : 测得照度0（希望 ≥ 300）
    uni1  : 均匀度1（希望 ≥ 0.7）
    uni2  : 均匀度2（希望 ≥ 0.5）
    power : 功率/能耗（原样最小化）

Outputs:
    out   : 单目标 Fitness（给 Galapagos，选择 Minimize）
    dbg   : 调试信息 [feasible, vE1, vE0, vU1, vU2, power]
"""

# ====== 阈值（可改成外部 Slider 输入） ======
E1_req = 750.0
E0_req = 500.0
U1_req = 0.70
U2_req = 0.50

# ====== 罚权重与指数（可按项目再调） ======
# 为了保证先满足标准，再比较能耗，把权重设得比 power 的量级大
# 也可以把 lam_scale 换成固定常数（如 1e3）
lam_scale = max(1.0, float(power) if power is not None else 1.0)

lam_E1 = 200.0 * lam_scale
lam_E0 = 150.0 * lam_scale
lam_U1 = 200.0 * lam_scale
lam_U2 = 150.0 * lam_scale

p = 2.0   # 二次罚，收敛更平滑

# ====== 安全数值转换 ======
def num(x, default=0.0):
    try: return float(x)
    except: return float(default)

illu1 = num(illu1)
illu0 = num(illu2)
uni1  = num(uni1)
uni2  = num(uni2)
power = num(power)

# ====== 欠满足惩罚（归一化欠口；达标=0，不足>0） ======
def hinge_under(val, req):
    if req <= 0: return 0.0
    return max(0.0, (req - val) / req)

vE1 = hinge_under(illu1, E1_req)   # illu1 对 500 的欠口 (0~1)
vE0 = hinge_under(illu0, E0_req)   # illu0 对 300 的欠口
vU1 = hinge_under(uni1,  U1_req)   # uni1  对 0.7 的欠口
vU2 = hinge_under(uni2,  U2_req)   # uni2  对 0.5 的欠口

# ====== 单目标 Fitness（越小越好） ======
a = (
    power
    + lam_E1 * (vE1 ** p)
    + lam_E0 * (vE0 ** p)
    + lam_U1 * (vU1 ** p)
    + lam_U2 * (vU2 ** p)
)
# ---------- end python_3_script_16 ----------

panel_48 = Panel(python_3_script_16.a)
