# Grasshopper definition light_simu_test.gh (Grasshopper 1.0.8)
# plug-ins: ClimateStudioGH, Bifocals, XiRui

cs_unitscale = CSUnitScale(
    From="Meters",
    To="ActiveRhinoDocUnits",
    Listener=True,
    Input_0_Hidden=False,
    Input_0_Name="From",
    Input_1_Hidden=False,
    Input_1_Name="To",
    Input_2_Hidden=False,
    Input_2_Name="Listener",
    UnitSystem=4)
series = Series(Start=-3, Step=-3.6, Count=3)
series_2 = Series(Start=2.5, Step=2.6, Count=3)
F = Number(cs_unitscale)
pt = ConstructPoint(XCoordinate=graft(series), YCoordinate=series_2, ZCoordinate=2.9)  # -> flatten(Point)
series_3 = Series(Start=-3, Step=-3.6, Count=3)
series_4 = Series(Start=2.5, Step=2.6, Count=3)
pt_2 = ConstructPoint(XCoordinate=graft(series_3), YCoordinate=series_4, ZCoordinate=2.9)  # -> flatten(Point)
ceiling = Brep(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)
mullion = Brep([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])
glazing = Brep([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])
grid = Brep(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)
ceiling_2 = Brep(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)
wall = Brep([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])
floor = Brep(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)
scale = Scale(Geometry=pt, Center=Point(0, 0, 0), Factor=F)  # -> Geometry, Transform
scale_2 = Scale(Geometry=ceiling, Center=Point(0, 0, 0), Factor=F)  # -> Geometry, Transform
scale_3 = Scale(Geometry=ceiling_2, Center=Point(0, 0, 0), Factor=F)  # -> Geometry, Transform
scale_4 = Scale(Geometry=floor, Center=Point(0, 0, 0), Factor=F)  # -> Geometry, Transform
scale_5 = Scale(Geometry=mullion, Center=Point(0, 0, 0), Factor=F)  # -> Geometry, Transform
scale_6 = Scale(Geometry=wall, Center=Point(0, 0, 0), Factor=F)  # -> Geometry, Transform
scale_7 = Scale(Geometry=glazing, Center=Point(0, 0, 0), Factor=F)  # -> Geometry, Transform
scale_8 = Scale(Geometry=grid, Center=Point(0, 0, 0), Factor=F)  # -> Geometry, Transform
scale_9 = Scale(Geometry=pt_2, Center=Point(0, 0, 0), Factor=F)  # -> Geometry, Transform
ceiling_3 = Brep(scale_2.Geometry)
floor_2 = Brep(scale_4.Geometry)
wall_2 = Brep(scale_6.Geometry)
grid_2 = Brep(scale_8.Geometry)
ceiling_4 = Brep(scale_3.Geometry)
glazing_2 = Brep(scale_7.Geometry)
mullion_2 = Brep(scale_5.Geometry)
Z = UnitZ(Factor=Slider(-1700, range=-10000..10000))
move = Move(Geometry=scale.Geometry, Motion=Z)  # -> Geometry, Transform
xy_plane = XYPlane(Origin=Point(0, 0, 0))
lightpos = Point(move.Geometry)
dup = DuplicateData(Data="False", Number=Slider(3, range=0..10), Order=True)
dup_2 = DuplicateData(Data="True", Number=Slider(6, range=0..10), Order=True)
Z_2 = UnitZ(Factor=Slider(500, range=-10000..10000))
move_2 = Move(Geometry=ceiling_4, Motion=Z_2)  # -> Geometry, Transform
rotate = Rotate(Geometry=xy_plane, Angle=1.570796327, Plane=PlaneXY(0, 0, 0))  # -> Geometry, Transform
cs_workflow_templates = CSWorkflowTemplates()
merge = Merge(Data1=dup_2, Data2=dup)
reduce = RandomReduce(List=lightpos, Reduction=Slider(6, range=0..10), Seed=1)
move_3 = Move(Geometry=scale_9.Geometry, Motion=Z_2)  # -> Geometry, Transform
lightpos_2 = Point(move_3.Geometry)
dispatch = Dispatch(List=lightpos_2, DispatchPattern=merge)  # -> ListA, ListB
plane_origin = PlaneOrigin(Base=rotate.Geometry, Origin=reduce)
xy_plane_2 = XYPlane(Origin=Point(0, 0, 0))
getcsluminaireproduct = GetCSLuminaireProduct(UnitSystem=4)
rotate_2 = Rotate(Geometry=xy_plane_2, Angle=1.570796327, Plane=PlaneXY(0, 0, 0))  # -> Geometry, Transform
changegui = ChangeGui(
    Switcher=ColourSwatch(SwatchColor=RGB(255, 255, 255)),
    Canvas_back=ColourSwatch(SwatchColor=RGB(19, 93, 105)),
    Canvas_grid=ColourSwatch(SwatchColor=RGB(143, 143, 143)),
    Canvas_wire=RGB(255, 255, 255))
get_cs_lightingmaterial = GetCSLightingMaterial(Search="White Laminate Desktop", UnitSystem=4)
get_cs_lightingmaterial_2 = GetCSLightingMaterial(Search="ceiling lm83", UnitSystem=4)
get_cs_lightingmaterial_3 = GetCSLightingMaterial(Search="floor lm83", UnitSystem=4)
get_cs_lightingmaterial_4 = GetCSLightingMaterial(UnitSystem=4)
get_cs_lightingmaterial_5 = GetCSLightingMaterial(Search="wall lm83", UnitSystem=4)
get_cs_lightingmaterial_6 = GetCSLightingMaterial(UnitSystem=4)
getcsluminaireproduct_2 = GetCSLuminaireProduct(UnitSystem=4)
place_cs_luminaire = PlaceCSLuminaire(
    LuminaireProduct=getcsluminaireproduct,
    Plane=plane_origin,
    WebSize=1,
    Output_0_Hidden=False,
    Output_0_Name="Luminaire",
    Output_1_Hidden=True,
    Output_1_Name="Lumens",
    UnitSystem=4,
    showArrow=True,
    showH=True,
    showV=True,
    showWireframe=True)
plane_origin_2 = PlaneOrigin(Base=rotate_2.Geometry, Origin=lightpos_2)
place_cs_luminaire_2 = PlaceCSLuminaire(
    LuminaireProduct=getcsluminaireproduct_2,
    Plane=plane_origin_2,
    WebSize=1,
    Output_0_Hidden=False,
    Output_0_Name="Luminaire",
    Output_1_Hidden=True,
    Output_1_Name="Lumens",
    UnitSystem=4,
    showArrow=True,
    showH=False,
    showV=True,
    showWireframe=True)
construct_cs_sensorgrid = ConstructCSSensorGrid(
    Level="LEVEL 01",
    Id="101",
    Description="Open office",
    Geometry=grid_2,
    Spacing=0.6096,
    Input_0_Hidden=True,
    Input_0_Name="Building",
    Input_10_Hidden=True,
    Input_10_Name="SupplementalLux",
    Input_11_Hidden=True,
    Input_11_Name="TargetLux",
    Input_12_Hidden=True,
    Input_12_Name="ExcessiveLux",
    Input_13_Hidden=True,
    Input_13_Name="sDA_Time",
    Input_14_Hidden=True,
    Input_14_Name="BREEAMSpaceType",
    Input_15_Hidden=True,
    Input_15_Name="ViewOffset",
    Input_16_Hidden=True,
    Input_16_Name="ViewDirections",
    Input_17_Hidden=True,
    Input_17_Name="ViewRotation",
    Input_18_Hidden=True,
    Input_18_Name="Points Override",
    Input_19_Hidden=True,
    Input_19_Name="Normals Override",
    Input_1_Hidden=False,
    Input_1_Name="Level",
    Input_20_Hidden=True,
    Input_20_Name="Disk Radius",
    Input_21_Hidden=True,
    Input_21_Name="Max Radius",
    Input_22_Hidden=True,
    Input_22_Name="Normal Override"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)
construct_cs_scenelayer = ConstructCSSceneLayer(
    Name="TABLE",
    Material=get_cs_lightingmaterial,
    Geometry=ceiling_3,
    Input_0_Hidden=False,
    Input_0_Name="Name",
    Input_1_Hidden=False,
    Input_1_Name="Material",
    Input_2_Hidden=False,
    Input_2_Name="Geometry",
    Input_3_Hidden=True,
    Input_3_Name="ViewTag",
    UnitSystem=4,
    Input_3_GHParam_Branch0_Path="{0}",
    Input_3_GHParam_Branch0_Item0_null_string=False,
    Input_3_GHParam_Branch0_Item0_string="None")
construct_cs_scenelayer_2 = ConstructCSSceneLayer(
    Name="FLOOR",
    Material=get_cs_lightingmaterial_3,
    Geometry=floor_2,
    Input_0_Hidden=False,
    Input_0_Name="Name",
    Input_1_Hidden=False,
    Input_1_Name="Material",
    Input_2_Hidden=False,
    Input_2_Name="Geometry",
    Input_3_Hidden=True,
    Input_3_Name="ViewTag",
    UnitSystem=4,
    Input_3_GHParam_Branch0_Path="{0}",
    Input_3_GHParam_Branch0_Item0_null_string=False,
    Input_3_GHParam_Branch0_Item0_string="None")
construct_cs_scenelayer_3 = ConstructCSSceneLayer(
    Name="MULLION",
    Material=get_cs_lightingmaterial_4,
    Geometry=mullion_2,
    Input_0_Hidden=False,
    Input_0_Name="Name",
    Input_1_Hidden=False,
    Input_1_Name="Material",
    Input_2_Hidden=False,
    Input_2_Name="Geometry",
    Input_3_Hidden=True,
    Input_3_Name="ViewTag",
    UnitSystem=4,
    Input_3_GHParam_Branch0_Path="{0}",
    Input_3_GHParam_Branch0_Item0_null_string=False,
    Input_3_GHParam_Branch0_Item0_string="None")
construct_cs_scenelayer_4 = ConstructCSSceneLayer(
    Name="WALL",
    Material=get_cs_lightingmaterial_5,
    Geometry=wall_2,
    Input_0_Hidden=False,
    Input_0_Name="Name",
    Input_1_Hidden=False,
    Input_1_Name="Material",
    Input_2_Hidden=False,
    Input_2_Name="Geometry",
    Input_3_Hidden=True,
    Input_3_Name="ViewTag",
    UnitSystem=4,
    Input_3_GHParam_Branch0_Path="{0}",
    Input_3_GHParam_Branch0_Item0_null_string=False,
    Input_3_GHParam_Branch0_Item0_string="None")
construct_cs_scenelayer_5 = ConstructCSSceneLayer(
    Name="GLAZING",
    Material=get_cs_lightingmaterial_6,
    Geometry=glazing_2,
    Input_0_Hidden=False,
    Input_0_Name="Name",
    Input_1_Hidden=False,
    Input_1_Name="Material",
    Input_2_Hidden=False,
    Input_2_Name="Geometry",
    Input_3_Hidden=True,
    Input_3_Name="ViewTag",
    UnitSystem=4,
    Input_3_GHParam_Branch0_Path="{0}",
    Input_3_GHParam_Branch0_Item0_null_string=False,
    Input_3_GHParam_Branch0_Item0_string="None")
construct_cs_scenelayer_6 = ConstructCSSceneLayer(
    Name="CEILING",
    Material=get_cs_lightingmaterial_2,
    Geometry=move_2.Geometry,
    Input_0_Hidden=False,
    Input_0_Name="Name",
    Input_1_Hidden=False,
    Input_1_Name="Material",
    Input_2_Hidden=False,
    Input_2_Name="Geometry",
    Input_3_Hidden=True,
    Input_3_Name="ViewTag",
    UnitSystem=4,
    Input_3_GHParam_Branch0_Path="{0}",
    Input_3_GHParam_Branch0_Item0_null_string=False,
    Input_3_GHParam_Branch0_Item0_string="None")
relay = Relay([place_cs_luminaire_2, place_cs_luminaire])
data = Data(flatten([construct_cs_scenelayer_6, construct_cs_scenelayer_2, construct_cs_scenelayer_3, construct_cs_scenelayer_4, construct_cs_scenelayer_5]))
panel = Panel(getcsluminaireproduct_2)
construct_cs_daylightmodel = ConstructCSDaylightModel(
    SceneLayers=data,
    Luminaires=flatten(relay),
    SensorGrids=construct_cs_sensorgrid,
    NorthOffset=0,
    Input_0_Hidden=False,
    Input_0_Name="SceneLayers",
    Input_1_Hidden=True,
    Input_1_Name="Windows",
    Input_2_Hidden=False,
    Input_2_Name="Luminaires",
    Input_3_Hidden=False,
    Input_3_Name="Tubular Devices",
    Input_4_Hidden=False,
    Input_4_Name="SensorGrids",
    Input_5_Hidden=False,
    Input_5_Name="Camera",
    Input_6_Hidden=False,
    Input_6_Name="North Offset",
    UnitSystem=4)
# Simple Office\Electric Lighting test A
panel_2 = Panel("Simple Office\Electric Lighting parameter test A")
fc_max = Panel("500")
run = Button()
construct_domain = ConstructDomain(DomainStart=0, DomainEnd=fc_max)
get_cs_gradient = GetCSGradient(Steps=0, UnitSystem=4)
run_cs_illuminance = RunCSIlluminance(
    Name=panel_2,
    Model=construct_cs_daylightmodel,
    Samples=4096,
    Run=Toggle(True),
    Input_0_Hidden=False,
    Input_0_Name="Name",
    Input_10_Hidden=False,
    Input_10_Name="Run",
    Input_1_Hidden=False,
    Input_1_Name="Model",
    Input_2_Hidden=False,
    Input_2_Name="Sky",
    Input_3_Hidden=False,
    Input_3_Name="Samples",
    Input_4_Hidden=True,
    Input_4_Name="Threads",
    Input_5_Hidden=True,
    Input_5_Name="Radiance Params",
    Input_6_Hidden=True,
    Input_6_Name="Spectral",
    Input_7_Hidden=True,
    Input_7_Name="Ambient Bounces",
    Input_8_Hidden=True,
    Input_8_Name="Hide Pop-up",
    Input_9_Hidden=True,
    Input_9_Name="Weight Limit",
    UnitSystem=4,
    Input_4_GHParam_Branch0_Path="{0}",
    Input_4_GHParam_Branch0_Item0_number=0,
    Input_6_GHParam_Branch0_Path="{0}",
    Input_6_GHParam_Branch0_Item0_boolean=False,
    Input_7_GHParam_Branch0_Path="{0}",
    Input_7_GHParam_Branch0_Item0_number=6,
    Input_8_GHParam_Branch0_Path="{0}",
    Input_8_GHParam_Branch0_Item0_boolean=False,
    Input_9_GHParam_Branch0_Path="{0}",
    Input_9_GHParam_Branch0_Item0_number=0.01)
load_cs_result = LoadCSResult(
    Result=run_cs_illuminance,
    Header=False,
    Output_0_Hidden=False,
    Output_0_Name="Name",
    Output_10_Hidden=True,
    Output_10_Name="Window Groups",
    Output_11_Hidden=True,
    Output_11_Name="Weather",
    Output_12_Hidden=True,
    Output_12_Name="North",
    Output_13_Hidden=True,
    Output_13_Name="LayerNames",
    Output_14_Hidden=True,
    Output_14_Name="LayerObjects",
    Output_15_Hidden=True,
    Output_15_Name="LayerMaterials",
    Output_16_Hidden=True,
    Output_16_Name="Sky",
    Output_1_Hidden=False,
    Output_1_Name="Type",
    Output_2_Hidden=True,
    Output_2_Name="Standard",
    Output_3_Hidden=True,
    Output_3_Name="Date",
    Output_4_Hidden=True,
    Output_4_Name="Version",
    Output_5_Hidden=True,
    Output_5_Name="FileSize",
    Output_6_Hidden=True,
    Output_6_Name="RunLog",
    Output_7_Hidden=False,
    Output_7_Name="Metrics",
    Output_8_Hidden=False,
    Output_8_Name="MetricValues",
    Output_9_Hidden=False,
    Output_9_Name="Grids",
    UnitSystem=4)  # -> Name, Type, Metrics, MetricValues, Grids
construct_cs_falsecolor = ConstructCSFalsecolor(GradientS=get_cs_gradient, DomainS=construct_domain, Log=False, Decades=3, UnitSystem=4)
panel_3 = Panel(run_cs_illuminance)
list_length = ListLength(List=load_cs_result.Metrics)
preview_cs_sensorgrid = PreviewCSSensorGrid(
    Grid=load_cs_result.Grids,
    Metric="Illuminance [lux]",
    Falsecolor=construct_cs_falsecolor,
    Input_0_Hidden=False,
    Input_0_Name="Grid",
    Input_1_Hidden=False,
    Input_1_Name="Metric",
    Input_2_Hidden=False,
    Input_2_Name="Falsecolor",
    Input_3_Hidden=True,
    Input_3_Name="Sensor Values",
    Input_4_Hidden=True,
    Input_4_Name="Show Points",
    Input_5_Hidden=True,
    Input_5_Name="Show Edges",
    Input_6_Hidden=True,
    Input_6_Name="Show Labels",
    Input_7_Hidden=True,
    Input_7_Name="Label Format",
    Input_8_Hidden=True,
    Input_8_Name="Transform",
    Input_9_Hidden=True,
    Input_9_Name="Max Radius",
    Output_0_Hidden=True,
    Output_0_Name="Mesh",
    Output_1_Hidden=True,
    Output_1_Name="Texture",
    UnitSystem=4,
    Input_4_GHParam_Branch0_Path="{0}",
    Input_4_GHParam_Branch0_Item0_boolean=True,
    Input_5_GHParam_Branch0_Path="{0}",
    Input_5_GHParam_Branch0_Item0_boolean=True,
    Input_6_GHParam_Branch0_Path="{0}",
    Input_6_GHParam_Branch0_Item0_boolean=False,
    Input_9_GHParam_Branch0_Path="{0}",
    Input_9_GHParam_Branch0_Item0_number=0)
duplicate_data = DuplicateData(Data="************************", Number=list_length, Order=True)
extract_cs_sensorgrid_data = ExtractCSSensorGridData(
    Grid=load_cs_result.Grids,
    Metric="Illuminance [lux]",
    Input_0_Hidden=False,
    Input_0_Name="Grid",
    Input_1_Hidden=False,
    Input_1_Name="Metric",
    UnitSystem=4)  # -> Metric, ValueS
deconstruct_cs_sensorgrid = DeconstructCSSensorGrid(
    Grid=load_cs_result.Grids,
    Output_0_Hidden=False,
    Output_0_Name="Building",
    Output_10_Hidden=True,
    Output_10_Name="Analysis Surface",
    Output_11_Hidden=True,
    Output_11_Name="Edges",
    Output_12_Hidden=True,
    Output_12_Name="View Points",
    Output_13_Hidden=True,
    Output_13_Name="Area",
    Output_14_Hidden=True,
    Output_14_Name="View Directions",
    Output_15_Hidden=False,
    Output_15_Name="Occupancy",
    Output_16_Hidden=True,
    Output_16_Name="View Wedges",
    Output_17_Hidden=True,
    Output_17_Name="Supplemental Lux",
    Output_18_Hidden=True,
    Output_18_Name="Target Lux",
    Output_19_Hidden=True,
    Output_19_Name="Excessive Lux",
    Output_1_Hidden=False,
    Output_1_Name="Level",
    Output_20_Hidden=True,
    Output_20_Name="Normal Override",
    Output_21_Hidden=True,
    Output_21_Name="Use Normal Override",
    Output_22_Hidden=True,
    Output_22_Name="Perimeter Edges"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)  # -> Building, Level, ID, SensorPoints, Occupancy
weave = Weave(
    Pattern=[0, 1, 2],
    Stream0=duplicate_data,
    Stream1=load_cs_result.Metrics,
    Stream2=load_cs_result.MetricValues,
    NullGaps=False)
metrics = Panel(weave)
panel_4 = Panel(extract_cs_sensorgrid_data.ValueS)
text_tag = TextTag(Location=deconstruct_cs_sensorgrid.SensorPoints, Text=extract_cs_sensorgrid_data.ValueS)
