# Grasshopper definition light_simu_test-new.gh (Grasshopper 1.0.8)
# plug-ins: ClimateStudioGH, Bifocals, XiRui

# ----
# geometry setting
cs_unitscale = CSUnitScale(
    From="Meters",
    To="ActiveRhinoDocUnits",
    Listener=True,
    Input_0_Hidden=False,
    Input_0_Name="From",
    Input_1_Hidden=False,
    Input_1_Name="To",
    Input_2_Hidden=False,
    Input_2_Name="Listener",
    UnitSystem=4)
F = Number(cs_unitscale)
ceiling = Brep([<brep referenced from the Rhino model> x69])
ceiling_2 = Brep([<brep referenced from the Rhino model> x23])
mullion = Brep([<brep referenced from the Rhino model> x72])
glazing = Brep([<brep referenced from the Rhino model> x12])
ceiling_3 = Brep(<brep referenced from the Rhino model>)
wall = Brep([<brep referenced from the Rhino model> x6])
floor = Brep([<brep referenced from the Rhino model> x8])
scale = Scale(Geometry=ceiling, Center=Point(0, 0, 0), Factor=F)  # -> Geometry, Transform
scale_2 = Scale(Geometry=ceiling_3, Center=Point(0, 0, 0), Factor=F)  # -> Geometry, Transform
scale_3 = Scale(Geometry=floor, Center=Point(0, 0, 0), Factor=F)  # -> Geometry, Transform
scale_4 = Scale(Geometry=mullion, Center=Point(0, 0, 0), Factor=F)  # -> Geometry, Transform
scale_5 = Scale(Geometry=wall, Center=Point(0, 0, 0), Factor=F)  # -> Geometry, Transform
scale_6 = Scale(Geometry=glazing, Center=Point(0, 0, 0), Factor=F)  # -> Geometry, Transform
scale_7 = Scale(Geometry=ceiling_2, Center=Point(0, 0, 0), Factor=F)  # -> Geometry, Transform
floor_2 = Brep(scale_3.Geometry)
wall_2 = Brep(scale_5.Geometry)
ceiling_4 = Brep(scale_2.Geometry)
glazing_2 = Brep(scale_6.Geometry)
mullion_2 = Brep(scale_4.Geometry)
ceiling_5 = Brep(scale.Geometry)
ceiling_6 = Brep(scale_7.Geometry)
get_cs_lightingmaterial = GetCSLightingMaterial(UnitSystem=4)
get_cs_lightingmaterial_2 = GetCSLightingMaterial(Search="ceiling lm83", UnitSystem=4)
get_cs_lightingmaterial_3 = GetCSLightingMaterial(Search="floor lm83", UnitSystem=4)
get_cs_lightingmaterial_4 = GetCSLightingMaterial(UnitSystem=4)
get_cs_lightingmaterial_5 = GetCSLightingMaterial(Search="wall lm83", UnitSystem=4)
get_cs_lightingmaterial_6 = GetCSLightingMaterial(UnitSystem=4)
get_cs_lightingmaterial_7 = GetCSLightingMaterial(Search="White Table Top", UnitSystem=4)
construct_cs_scenelayer = ConstructCSSceneLayer(
    Name="monitor",
    Material=get_cs_lightingmaterial,
    Geometry=ceiling_5,
    Input_0_Hidden=False,
    Input_0_Name="Name",
    Input_1_Hidden=False,
    Input_1_Name="Material",
    Input_2_Hidden=False,
    Input_2_Name="Geometry",
    Input_3_Hidden=True,
    Input_3_Name="ViewTag",
    UnitSystem=4,
    Input_3_GHParam_Branch0_Path="{0}",
    Input_3_GHParam_Branch0_Item0_null_string=False,
    Input_3_GHParam_Branch0_Item0_string="None")
construct_cs_scenelayer_2 = ConstructCSSceneLayer(
    Name="CEILING",
    Material=get_cs_lightingmaterial_2,
    Geometry=ceiling_4,
    Input_0_Hidden=False,
    Input_0_Name="Name",
    Input_1_Hidden=False,
    Input_1_Name="Material",
    Input_2_Hidden=False,
    Input_2_Name="Geometry",
    Input_3_Hidden=True,
    Input_3_Name="ViewTag",
    UnitSystem=4,
    Input_3_GHParam_Branch0_Path="{0}",
    Input_3_GHParam_Branch0_Item0_null_string=False,
    Input_3_GHParam_Branch0_Item0_string="None")
construct_cs_scenelayer_3 = ConstructCSSceneLayer(
    Name="FLOOR",
    Material=get_cs_lightingmaterial_3,
    Geometry=floor_2,
    Input_0_Hidden=False,
    Input_0_Name="Name",
    Input_1_Hidden=False,
    Input_1_Name="Material",
    Input_2_Hidden=False,
    Input_2_Name="Geometry",
    Input_3_Hidden=True,
    Input_3_Name="ViewTag",
    UnitSystem=4,
    Input_3_GHParam_Branch0_Path="{0}",
    Input_3_GHParam_Branch0_Item0_null_string=False,
    Input_3_GHParam_Branch0_Item0_string="None")
construct_cs_scenelayer_4 = ConstructCSSceneLayer(
    Name="MULLION",
    Material=get_cs_lightingmaterial_4,
    Geometry=mullion_2,
    Input_0_Hidden=False,
    Input_0_Name="Name",
    Input_1_Hidden=False,
    Input_1_Name="Material",
    Input_2_Hidden=False,
    Input_2_Name="Geometry",
    Input_3_Hidden=True,
    Input_3_Name="ViewTag",
    UnitSystem=4,
    Input_3_GHParam_Branch0_Path="{0}",
    Input_3_GHParam_Branch0_Item0_null_string=False,
    Input_3_GHParam_Branch0_Item0_string="None")
construct_cs_scenelayer_5 = ConstructCSSceneLayer(
    Name="WALL",
    Material=get_cs_lightingmaterial_5,
    Geometry=wall_2,
    Input_0_Hidden=False,
    Input_0_Name="Name",
    Input_1_Hidden=False,
    Input_1_Name="Material",
    Input_2_Hidden=False,
    Input_2_Name="Geometry",
    Input_3_Hidden=True,
    Input_3_Name="ViewTag",
    UnitSystem=4,
    Input_3_GHParam_Branch0_Path="{0}",
    Input_3_GHParam_Branch0_Item0_null_string=False,
    Input_3_GHParam_Branch0_Item0_string="None")
construct_cs_scenelayer_6 = ConstructCSSceneLayer(
    Name="GLAZING",
    Material=get_cs_lightingmaterial_6,
    Geometry=glazing_2,
    Input_0_Hidden=False,
    Input_0_Name="Name",
    Input_1_Hidden=False,
    Input_1_Name="Material",
    Input_2_Hidden=False,
    Input_2_Name="Geometry",
    Input_3_Hidden=True,
    Input_3_Name="ViewTag",
    UnitSystem=4,
    Input_3_GHParam_Branch0_Path="{0}",
    Input_3_GHParam_Branch0_Item0_null_string=False,
    Input_3_GHParam_Branch0_Item0_string="None")
construct_cs_scenelayer_7 = ConstructCSSceneLayer(
    Name="TABLE",
    Material=get_cs_lightingmaterial_7,
    Geometry=ceiling_6,
    Input_0_Hidden=False,
    Input_0_Name="Name",
    Input_1_Hidden=False,
    Input_1_Name="Material",
    Input_2_Hidden=False,
    Input_2_Name="Geometry",
    Input_3_Hidden=True,
    Input_3_Name="ViewTag",
    UnitSystem=4,
    Input_3_GHParam_Branch0_Path="{0}",
    Input_3_GHParam_Branch0_Item0_null_string=False,
    Input_3_GHParam_Branch0_Item0_string="None")
data = Data(flatten([construct_cs_scenelayer_2, construct_cs_scenelayer_3, construct_cs_scenelayer_4, construct_cs_scenelayer_5, construct_cs_scenelayer_6, construct_cs_scenelayer_7, construct_cs_scenelayer]))

# ----
# task areas
# seats number
# surrounding areas
number_slider = Slider(2, range=0..10)
deconstruct_brep = DeconstructBrep(Brep=ceiling_6)  # -> Faces, Edges, Vertices
list_item = ListItem(List=deconstruct_brep.Edges, Index=number_slider, Wrap=True)
curve_middle = CurveMiddle(Curve=list_item)  # -> flatten(Midpoint)
number_slider_2 = Slider(1, range=0..10)  # disabled
evaluate_curve = EvaluateCurve(Curve=reparameterize(flatten(list_item)), Parameter=flatten("0.5"))  # -> Point, Tangent, Angle
point_list = PointList(Points=curve_middle, Size=number_slider_2)  # disabled
vector_display = VectorDisplay(Anchor=curve_middle, Vector=evaluate_curve.Tangent)  # disabled
rotate = Rotate(Geometry=evaluate_curve.Tangent, Angle=degrees("-90"), Plane=PlaneXY(0, 0, 0))  # -> Geometry, Transform
vector_display_2 = VectorDisplay(Anchor=curve_middle, Vector=rotate.Geometry)  # disabled
number_slider_3 = Slider(0.7, range=0..1)
panel = Panel("-0.5")
center_box = CenterBox(Base=curve_middle, X=Slider(1, range=0..1), Y=Slider(0.5, range=0..1), Z=Slider(0, range=0..100))  # -> graft(Box)
multiplication = Multiplication(A=rotate.Geometry, B="-0.5")
multiplication_2 = Multiplication(A=evaluate_curve.Tangent, B="-0.5", C=number_slider_3)
line_sdl = LineSDL(Start=curve_middle, Direction=evaluate_curve.Tangent, Length=number_slider_3)
deconstruct_brep_2 = DeconstructBrep(Brep=center_box)  # -> Faces, Edges, Vertices
line_sdl_2 = LineSDL(Start=curve_middle, Direction=multiplication, Length=multiplication)  # -> graft(Line)
move = Move(Geometry=line_sdl, Motion=multiplication_2)  # -> graft(Geometry), Transform
sweep1 = Sweep1(Rail=line_sdl_2, Sections=move.Geometry, Miter=1)  # -> flatten(Brep)
list_item_2 = ListItem(List=deconstruct_brep_2.Faces, Index=Slider(5, range=0..10), Wrap=True)  # -> flatten(Item)
list_item_3 = ListItem(List=list_item_2, Index="-1", Wrap=True)
area = Area(Geometry=list_item_3)  # -> Area, Centroid
rotate_2 = Rotate(Geometry=list_item_3, Angle=degrees("90"), Plane=area.Centroid)  # -> Geometry, Transform
replace_items = ReplaceItems(List=list_item_2, Item=rotate_2.Geometry, Indices=Slider(22, range=0..100), Wrap=False)
region_difference = RegionDifference(CurvesA=graft(replace_items), CurvesB=graft(sweep1))  # -> flatten(Result)

# ----
# ceiling lights position
number_slider_4 = Slider(3, range=0..10)
surface = Surface(<surface referenced from the Rhino model>)
divide_surface = DivideSurface(Surface=surface, UCount=number_slider_4, VCount=Slider(8, range=0..10))  # -> flatten(Points), Normals, Parameters
scale_8 = Scale(Geometry=divide_surface.Points, Center=Point(0, 0, 0), Factor=F)  # -> Geometry, Transform
point_list_2 = PointList(Points=scale_8.Geometry)
lightpos = Point(scale_8.Geometry)
panel_2 = Panel("""16
17
25
26
34
35""")
xy_plane = XYPlane(Origin=Point(0, 0, 0))
cull_index = CullIndex(List=lightpos, Indices=panel_2, Wrap=True)
rotate_3 = Rotate(Geometry=xy_plane, Angle=degrees(Slider(0, range=0..100)), Plane=PlaneXY(0, 0, 0))  # -> Geometry, Transform
plane_origin = PlaneOrigin(Base=rotate_3.Geometry, Origin=cull_index)
vector_xyz = VectorXYZ(XComponent=Slider(0.55, range=0..1), YComponent=0, ZComponent=Slider(2.6, range=0..10))  # -> Vector, Length
move_2 = Move(Geometry=plane_origin, Motion=vector_xyz.Vector)  # -> Geometry, Transform

getcsluminaireproduct = GetCSLuminaireProduct(SearchName="Linear 4' Direct (Flood) - 3900 lm - task - 1/6", UnitSystem=4)
getcsluminaireproduct_2 = GetCSLuminaireProduct(SearchName="Linear 4' Direct (Flood) - 3900 lm - task - 2/6", UnitSystem=4)
getcsluminaireproduct_3 = GetCSLuminaireProduct(SearchName="Linear 4' Direct (Flood) - 3900 lm - task - 0/6", UnitSystem=4)
getcsluminaireproduct_4 = GetCSLuminaireProduct(SearchName="Linear 4' Direct (Flood) - 3900 lm - ceiling - 1/5", UnitSystem=4)
getcsluminaireproduct_5 = GetCSLuminaireProduct(SearchName="Linear 4' Direct (Flood) - 3900 lm - ceiling - 2/5", UnitSystem=4)
getcsluminaireproduct_6 = GetCSLuminaireProduct(SearchName="Linear 4' Direct (Flood) - 3900 lm - ceiling - 4/5", UnitSystem=4)
getcsluminaireproduct_7 = GetCSLuminaireProduct(SearchName="Linear 4' Direct (Flood) - 3900 lm - ceiling - 3/5", UnitSystem=4)
ceiling_light_full_load_power = Panel("9")
division = Division(A=ceiling_light_full_load_power, B=Slider(6, range=0..10))
changegui = ChangeGui(
    Switcher=ColourSwatch(SwatchColor=RGB(255, 255, 255)),
    Canvas_back=ColourSwatch(SwatchColor=RGB(19, 93, 105)),
    Canvas_grid=ColourSwatch(SwatchColor=RGB(143, 143, 143)),
    Canvas_wire=RGB(255, 255, 255))
list_length = ListLength(List=move_2.Geometry)
grid = Brep(<brep referenced from the Rhino model>)

# ----
# light analysis plan
grid_2 = Brep(<brep referenced from the Rhino model>)
scale_9 = Scale(Geometry=grid, Center=Point(0, 0, 0), Factor=F)  # -> Geometry, Transform
grid_3 = Brep(scale_9.Geometry)
construct_cs_sensorgrid = ConstructCSSensorGrid(
    Level="LEVEL 01",
    Id="101",
    Description="Open office",
    Geometry=grid_3,
    Spacing=Slider(0.2, range=0..1),
    Input_0_Hidden=True,
    Input_0_Name="Building",
    Input_10_Hidden=True,
    Input_10_Name="SupplementalLux",
    Input_11_Hidden=True,
    Input_11_Name="TargetLux",
    Input_12_Hidden=True,
    Input_12_Name="ExcessiveLux",
    Input_13_Hidden=True,
    Input_13_Name="sDA_Time",
    Input_14_Hidden=True,
    Input_14_Name="BREEAMSpaceType",
    Input_15_Hidden=True,
    Input_15_Name="ViewOffset",
    Input_16_Hidden=True,
    Input_16_Name="ViewDirections",
    Input_17_Hidden=True,
    Input_17_Name="ViewRotation",
    Input_18_Hidden=True,
    Input_18_Name="Points Override",
    Input_19_Hidden=True,
    Input_19_Name="Normals Override",
    Input_1_Hidden=False,
    Input_1_Name="Level",
    Input_20_Hidden=True,
    Input_20_Name="Disk Radius",
    Input_21_Hidden=True,
    Input_21_Name="Max Radius",
    Input_22_Hidden=True,
    Input_22_Name="Normal Override"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)

cs_workflow_templates = CSWorkflowTemplates()
# Environmental inputs
seed = Slider(535, range=0..1000)

# ----
# output where people sit
# occupant count 0-10
# occupant location 0-22
panel_3 = Panel("1 to 11")
random = Random(Range=panel_3, Number="1", Seed=seed)
panel_4 = Panel(random)
integer = Integer(random)
series = Series(Start=Slider(0, range=0..100), Step=1, Count=Slider(23, range=0..100))
panel_5 = Panel(integer)
jitter = Jitter(List=series, Jitter=Slider(1, range=0..1), Seed=seed)  # -> Values, Indices
panel_6 = Panel("1")
split_list = SplitList(List=jitter.Values, Index=integer)  # -> ListA, ListB

# ----
# random occupant task
# and surrounding areas
list_item_4 = ListItem(List=sweep1, Index=split_list.ListA, Wrap=True)  # -> graft(Item)
list_item_5 = ListItem(List=region_difference, Index=split_list.ListA, Wrap=True)  # -> graft(Item)

# ----
# 7 light class choice for task light (0-6) start with no light
# Decision variables
number_slider_5 = Slider(0, range=0..6)
# 5 light class choice for ceiling light (0-4)
number_slider_6 = Slider(0, range=0..4)

# ----
# seat location
data_2 = Data(split_list.ListA)

# ----
# simulation button
run = Button()
galapagos = Galapagos(fitness=mass_addition, gene=[number_slider_5, number_slider_6])

# ----
# 4 classes ceiling light
# 4 class ceiling light corresponding power (all 30)
panel_7 = Panel("Linear 4' Direct (Flood) - 3900 lm - ceiling - 5/5")
ceiling_light_full_load_power_2 = Panel("22")
number_slider_7 = Slider(0, range=0..3)
getcsluminaireproduct_8 = GetCSLuminaireProduct(UnitSystem=4)
addition = Addition(A=number_slider_6, B="1")
division_2 = Division(A=ceiling_light_full_load_power_2, B=Slider(5, range=0..10))
multiplication_3 = Multiplication(A=addition, B=division_2)
# daylight - too many factors, sun position, sunlight
# so in this just think about during light
# also, in the occupant count file, still many members stay here late
panel_8 = Panel(multiplication_3)

# ----
# control strategy of ceiling light
getcsluminaireproduct_9 = GetCSLuminaireProduct(SearchName=panel_7, UnitSystem=4)

merge = Merge(
    Data1=getcsluminaireproduct_4,
    Data2=getcsluminaireproduct_5,
    Data3=getcsluminaireproduct_7,
    Data4=getcsluminaireproduct_6,
    Data5=getcsluminaireproduct_9)
list_item_6 = ListItem(List=merge, Index=number_slider_6, Wrap=True)

multiplication_4 = Multiplication(A=multiplication_3, B=list_length)
panel_9 = Panel(multiplication_4)
place_cs_luminaire = PlaceCSLuminaire(
    LuminaireProduct=list_item_6,
    Plane=move_2.Geometry,
    WebSize=1,
    Output_0_Hidden=False,
    Output_0_Name="Luminaire",
    Output_1_Hidden=True,
    Output_1_Name="Lumens",
    UnitSystem=4,
    showArrow=True,
    showH=False,
    showV=True,
    showWireframe=True)
panel_10 = Panel(place_cs_luminaire)

# ----
# control strategy of ceiling light
# 4 class task light corresponding power (all using)
panel_11 = Panel("Linear 4' Direct (Flood) - 3900 lm - task - 6/6")
getcsluminaireproduct_10 = GetCSLuminaireProduct(SearchName="Linear 4' Direct (Flood) - 3900 lm - task - 4/6", UnitSystem=4)
getcsluminaireproduct_11 = GetCSLuminaireProduct(SearchName="Linear 4' Direct (Flood) - 3900 lm - task - 5/6", UnitSystem=4)
getcsluminaireproduct_12 = GetCSLuminaireProduct(SearchName="Linear 4' Direct (Flood) - 3900 lm - task - 3/6", UnitSystem=4)
getcsluminaireproduct_13 = GetCSLuminaireProduct(UnitSystem=4)
multiplication_5 = Multiplication(A=number_slider_5, B=division)
panel_12 = Panel(multiplication_5)

getcsluminaireproduct_14 = GetCSLuminaireProduct(SearchName=panel_11, UnitSystem=4)

merge_2 = Merge(
    Data1=getcsluminaireproduct_3,
    Data2=getcsluminaireproduct,
    Data3=getcsluminaireproduct_2,
    Data4=getcsluminaireproduct_12,
    Data5=getcsluminaireproduct_10,
    Data6=getcsluminaireproduct_11,
    Data7=getcsluminaireproduct_14)
list_item_7 = ListItem(List=merge_2, Index=number_slider_5, Wrap=True)

multiplication_6 = Multiplication(A=multiplication_5, B=integer)
panel_13 = Panel(multiplication_6)

# ----
# ceiling lights position
number_slider_8 = Slider(1, range=0..10)
deconstruct_brep_3 = DeconstructBrep(Brep=graft(sweep1))  # -> Faces, Edges, Vertices
list_item_8 = ListItem(List=deconstruct_brep_3.Edges, Index=number_slider_8, Wrap=True)
unit_z = UnitZ(Factor=Slider(0.5, range=0..1))
curve_middle_2 = CurveMiddle(Curve=list_item_8)
move_3 = Move(Geometry=curve_middle_2, Motion=unit_z)  # -> flatten(Geometry), Transform
place_cs_luminaire_2 = PlaceCSLuminaire(
    LuminaireProduct=list_item_7,
    Plane=move_3.Geometry,
    WebSize=1,
    Output_0_Hidden=False,
    Output_0_Name="Luminaire",
    Output_1_Hidden=True,
    Output_1_Name="Lumens",
    UnitSystem=4,
    showArrow=True,
    showH=False,
    showV=True,
    showWireframe=True)  # disabled

# ----
# according task light is on
list_item_9 = ListItem(List=move_3.Geometry, Index=split_list.ListA, Wrap=True)  # -> flatten(Item)
# seems the lights are set in group
# more group makes it way slower
place_cs_luminaire_3 = PlaceCSLuminaire(
    LuminaireProduct=list_item_7,
    Plane=list_item_9,
    WebSize=1,
    Output_0_Hidden=False,
    Output_0_Name="Luminaire",
    Output_1_Hidden=True,
    Output_1_Name="Lumens",
    UnitSystem=4,
    showArrow=True,
    showH=False,
    showV=True,
    showWireframe=True)
merge_3 = Merge(Data1=place_cs_luminaire, Data2=place_cs_luminaire_3)  # -> flatten(Result)
panel_14 = Panel(place_cs_luminaire_3)
panel_15 = Panel(merge_3)

construct_cs_daylightmodel = ConstructCSDaylightModel(
    SceneLayers=data,
    Luminaires=merge_3,
    SensorGrids=construct_cs_sensorgrid,
    NorthOffset=0,
    Input_0_Hidden=False,
    Input_0_Name="SceneLayers",
    Input_1_Hidden=True,
    Input_1_Name="Windows",
    Input_2_Hidden=False,
    Input_2_Name="Luminaires",
    Input_3_Hidden=False,
    Input_3_Name="Tubular Devices",
    Input_4_Hidden=False,
    Input_4_Name="SensorGrids",
    Input_5_Hidden=False,
    Input_5_Name="Camera",
    Input_6_Hidden=False,
    Input_6_Name="North Offset",
    UnitSystem=4)
fc_max = Panel("750")
construct_domain = ConstructDomain(DomainStart=0, DomainEnd=fc_max)
get_cs_gradient = GetCSGradient(Steps=0, UnitSystem=4)
# simulation
run_cs_illuminance = RunCSIlluminance(
    Name="Simple Office\Electric Lighting",
    Model=construct_cs_daylightmodel,
    Samples=4096,
    Run=run,
    Input_0_Hidden=False,
    Input_0_Name="Name",
    Input_10_Hidden=False,
    Input_10_Name="Run",
    Input_1_Hidden=False,
    Input_1_Name="Model",
    Input_2_Hidden=False,
    Input_2_Name="Sky",
    Input_3_Hidden=False,
    Input_3_Name="Samples",
    Input_4_Hidden=True,
    Input_4_Name="Threads",
    Input_5_Hidden=True,
    Input_5_Name="Radiance Params",
    Input_6_Hidden=True,
    Input_6_Name="Spectral",
    Input_7_Hidden=True,
    Input_7_Name="Ambient Bounces",
    Input_8_Hidden=True,
    Input_8_Name="Hide Pop-up",
    Input_9_Hidden=True,
    Input_9_Name="Weight Limit",
    UnitSystem=4,
    Input_4_GHParam_Branch0_Path="{0}",
    Input_4_GHParam_Branch0_Item0_number=0,
    Input_6_GHParam_Branch0_Path="{0}",
    Input_6_GHParam_Branch0_Item0_boolean=False,
    Input_7_GHParam_Branch0_Path="{0}",
    Input_7_GHParam_Branch0_Item0_number=6,
    Input_8_GHParam_Branch0_Path="{0}",
    Input_8_GHParam_Branch0_Item0_boolean=False,
    Input_9_GHParam_Branch0_Path="{0}",
    Input_9_GHParam_Branch0_Item0_number=0.01)
construct_cs_falsecolor = ConstructCSFalsecolor(GradientS=get_cs_gradient, DomainS=construct_domain, Log=False, Decades=3, UnitSystem=4)
load_cs_result = LoadCSResult(
    Result=run_cs_illuminance,
    Header=False,
    Output_0_Hidden=False,
    Output_0_Name="Name",
    Output_10_Hidden=True,
    Output_10_Name="Window Groups",
    Output_11_Hidden=True,
    Output_11_Name="Weather",
    Output_12_Hidden=True,
    Output_12_Name="North",
    Output_13_Hidden=True,
    Output_13_Name="LayerNames",
    Output_14_Hidden=True,
    Output_14_Name="LayerObjects",
    Output_15_Hidden=True,
    Output_15_Name="LayerMaterials",
    Output_16_Hidden=True,
    Output_16_Name="Sky",
    Output_1_Hidden=False,
    Output_1_Name="Type",
    Output_2_Hidden=True,
    Output_2_Name="Standard",
    Output_3_Hidden=True,
    Output_3_Name="Date",
    Output_4_Hidden=True,
    Output_4_Name="Version",
    Output_5_Hidden=True,
    Output_5_Name="FileSize",
    Output_6_Hidden=True,
    Output_6_Name="RunLog",
    Output_7_Hidden=False,
    Output_7_Name="Metrics",
    Output_8_Hidden=False,
    Output_8_Name="MetricValues",
    Output_9_Hidden=False,
    Output_9_Name="Grids",
    UnitSystem=4)  # -> Name, Type, Metrics, MetricValues, Grids
run_2 = Button()
preview_cs_sensorgrid = PreviewCSSensorGrid(
    Grid=load_cs_result.Grids,
    Metric="Illuminance [lux]",
    Falsecolor=construct_cs_falsecolor,
    Input_0_Hidden=False,
    Input_0_Name="Grid",
    Input_1_Hidden=False,
    Input_1_Name="Metric",
    Input_2_Hidden=False,
    Input_2_Name="Falsecolor",
    Input_3_Hidden=True,
    Input_3_Name="Sensor Values",
    Input_4_Hidden=True,
    Input_4_Name="Show Points",
    Input_5_Hidden=True,
    Input_5_Name="Show Edges",
    Input_6_Hidden=True,
    Input_6_Name="Show Labels",
    Input_7_Hidden=True,
    Input_7_Name="Label Format",
    Input_8_Hidden=True,
    Input_8_Name="Transform",
    Input_9_Hidden=True,
    Input_9_Name="Max Radius",
    Output_0_Hidden=True,
    Output_0_Name="Mesh",
    Output_1_Hidden=True,
    Output_1_Name="Texture",
    UnitSystem=4,
    Input_4_GHParam_Branch0_Path="{0}",
    Input_4_GHParam_Branch0_Item0_boolean=True,
    Input_5_GHParam_Branch0_Path="{0}",
    Input_5_GHParam_Branch0_Item0_boolean=True,
    Input_6_GHParam_Branch0_Path="{0}",
    Input_6_GHParam_Branch0_Item0_boolean=False,
    Input_9_GHParam_Branch0_Path="{0}",
    Input_9_GHParam_Branch0_Item0_number=0)
list_length_2 = ListLength(List=load_cs_result.Metrics)
duplicate_data = DuplicateData(Data="************************", Number=list_length_2, Order=True)
extract_cs_sensorgrid_data = ExtractCSSensorGridData(
    Grid=load_cs_result.Grids,
    Metric="Illuminance [lux]",
    Input_0_Hidden=False,
    Input_0_Name="Grid",
    Input_1_Hidden=False,
    Input_1_Name="Metric",
    UnitSystem=4)  # -> Metric, ValueS
deconstruct_cs_sensorgrid = DeconstructCSSensorGrid(
    Grid=load_cs_result.Grids,
    Output_0_Hidden=False,
    Output_0_Name="Building",
    Output_10_Hidden=True,
    Output_10_Name="Analysis Surface",
    Output_11_Hidden=True,
    Output_11_Name="Edges",
    Output_12_Hidden=True,
    Output_12_Name="View Points",
    Output_13_Hidden=True,
    Output_13_Name="Area",
    Output_14_Hidden=True,
    Output_14_Name="View Directions",
    Output_15_Hidden=False,
    Output_15_Name="Occupancy",
    Output_16_Hidden=True,
    Output_16_Name="View Wedges",
    Output_17_Hidden=True,
    Output_17_Name="Supplemental Lux",
    Output_18_Hidden=True,
    Output_18_Name="Target Lux",
    Output_19_Hidden=True,
    Output_19_Name="Excessive Lux",
    Output_1_Hidden=False,
    Output_1_Name="Level",
    Output_20_Hidden=True,
    Output_20_Name="Normal Override",
    Output_21_Hidden=True,
    Output_21_Name="Use Normal Override",
    Output_22_Hidden=True,
    Output_22_Name="Perimeter Edges"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)  # -> Building, Level, ID, SensorPoints, Occupancy
weave = Weave(
    Pattern=[0, 1, 2],
    Stream0=duplicate_data,
    Stream1=load_cs_result.Metrics,
    Stream2=load_cs_result.MetricValues,
    NullGaps=False)
metrics = Panel(weave)
panel_16 = Panel(extract_cs_sensorgrid_data.ValueS)  # disabled
text_tag = TextTag(Location=deconstruct_cs_sensorgrid.SensorPoints, Text=extract_cs_sensorgrid_data.ValueS)  # disabled

# ----
# Mean Illuminance of task area [lux]
# Each should > 500 lux
# Mean Illuminance of surrounding area [lux]
# Each should > 300 lux
unit_z_2 = UnitZ(Factor=1)
unit_z_3 = UnitZ(Factor=1)
extrude = Extrude(Base=list_item_5, Direction=unit_z_2)
extrude_2 = Extrude(Base=list_item_4, Direction=unit_z_3)
cap_holes = CapHoles(Brep=extrude)
point_in_brep = PointInBrep(Brep=extrude_2, Point=deconstruct_cs_sensorgrid.SensorPoints, Strict=False)
point_in_brep_2 = PointInBrep(Brep=cap_holes, Point=deconstruct_cs_sensorgrid.SensorPoints, Strict=False)
dispatch = Dispatch(List=deconstruct_cs_sensorgrid.SensorPoints, DispatchPattern=point_in_brep_2)  # -> ListA, ListB
dispatch_2 = Dispatch(List=deconstruct_cs_sensorgrid.SensorPoints, DispatchPattern=point_in_brep)  # -> ListA, ListB
dispatch_3 = Dispatch(List=extract_cs_sensorgrid_data.ValueS, DispatchPattern=point_in_brep_2)  # -> ListA, ListB
dispatch_4 = Dispatch(List=extract_cs_sensorgrid_data.ValueS, DispatchPattern=point_in_brep)  # -> ListA, ListB
point = Point(dispatch.ListA)
point_2 = Point(dispatch_2.ListA)

param_viewer = ParamViewer(dispatch_4.ListA)
panel_17 = Panel(dispatch_4.ListA)
panel_18 = Panel(dispatch_3.ListA)

# ----
# Mean Illuminance of task area [lux]
# Each should > 750 lux
# Mean Illuminance of surrounding area [lux]
# Each should > 500 lux
average = Average(Input=dispatch_4.ListA)  # -> flatten(ArithmeticMean)
average_2 = Average(Input=dispatch_3.ListA)  # -> flatten(ArithmeticMean)

# ----
# power in all
# Galapagos
mass_addition = MassAddition(Input=[multiplication_4, multiplication_6])  # -> Result, PartialResults

panel_19 = Panel(average)
# Objective variables
panel_20 = Panel(average_2)
sort_list = SortList(Keys=average_2)  # -> Keys, ValuesValuesA
list_item_10 = ListItem(List=sort_list.Keys, Index=0, Wrap=True)

# ----
# Task Uniformity > 0.7 (Emin/Eave)
# Surrounding Uniformity > 0.5 (Emin/Eave)
sort_list_2 = SortList(Keys=dispatch_3.ListA)  # -> Keys, ValuesValuesA
sort_list_3 = SortList(Keys=dispatch_4.ListA)  # -> Keys, ValuesA
list_item_11 = ListItem(List=sort_list_2.Keys, Index=0, Wrap=True)
list_item_12 = ListItem(List=sort_list_3.Keys, Index=0, Wrap=True)
division_3 = Division(A=flatten(list_item_11), B=average_2)
division_4 = Division(A=flatten(list_item_12), B=average)
panel_21 = Panel(division_3)
panel_22 = Panel(division_4)

multiplication_7 = Multiplication(A=list_item_10, B="-1")
