# Grasshopper definition light_simu_test.gh (Grasshopper 1.0.8)
# plug-ins: ClimateStudioGH, Bifocals, XiRui

# ----
# 4 classes ceiling light
# 4 class ceiling light corresponding power
panel = Panel("Linear 4' Direct (Flood) - 3900 lm - ceiling - 0.25")
getcsluminaireproduct = GetCSLuminaireProduct(SearchName=panel, UnitSystem=4)
getcsluminaireproduct_2 = GetCSLuminaireProduct(SearchName="Linear 4' Direct (Flood) - 3900 lm - ceiling - 0.5", UnitSystem=4)
getcsluminaireproduct_3 = GetCSLuminaireProduct(SearchName="Linear 4' Direct (Flood) - 3900 lm - ceiling - 1", UnitSystem=4)
getcsluminaireproduct_4 = GetCSLuminaireProduct(SearchName="Linear 4' Direct (Flood) - 3900 lm - ceiling - 0.75", UnitSystem=4)
ceiling_light_full_load_power = Panel("26")
getcsluminaireproduct_5 = GetCSLuminaireProduct(UnitSystem=4)
number_slider = Slider(3, range=0..3)
merge = Merge(Data1=getcsluminaireproduct, Data2=getcsluminaireproduct_2, Data3=getcsluminaireproduct_4, Data4=getcsluminaireproduct_3)
addition = Addition(A=number_slider, B="1")
list_item = ListItem(List=merge, Index=number_slider, Wrap=True)
division = Division(A=ceiling_light_full_load_power, B=Slider(4, range=0..10))
multiplication = Multiplication(A=addition, B=division)
# daylight - too many factors, sun position, sunlight
# so in this just think about during light
# also, in the occupant count file, still many members stay here late
panel_2 = Panel(multiplication)

# ----
# geometry setting
cs_unitscale = CSUnitScale(
    From="Meters",
    To="ActiveRhinoDocUnits",
    Listener=True,
    Input_0_Hidden=False,
    Input_0_Name="From",
    Input_1_Hidden=False,
    Input_1_Name="To",
    Input_2_Hidden=False,
    Input_2_Name="Listener",
    UnitSystem=4)
F = Number(cs_unitscale)
ceiling = Brep([<brep referenced from the Rhino model> x23])
ceiling_2 = Brep([<brep referenced from the Rhino model> x23])
mullion = Brep([<brep referenced from the Rhino model> x72])
glazing = Brep([<brep referenced from the Rhino model> x12])
ceiling_3 = Brep(<brep referenced from the Rhino model>)
wall = Brep([<brep referenced from the Rhino model> x6])
floor = Brep([<brep referenced from the Rhino model> x8])
scale = Scale(Geometry=ceiling, Center=Point(0, 0, 0), Factor=F)  # -> Geometry, Transform
scale_2 = Scale(Geometry=ceiling_3, Center=Point(0, 0, 0), Factor=F)  # -> Geometry, Transform
scale_3 = Scale(Geometry=floor, Center=Point(0, 0, 0), Factor=F)  # -> Geometry, Transform
scale_4 = Scale(Geometry=mullion, Center=Point(0, 0, 0), Factor=F)  # -> Geometry, Transform
scale_5 = Scale(Geometry=wall, Center=Point(0, 0, 0), Factor=F)  # -> Geometry, Transform
scale_6 = Scale(Geometry=glazing, Center=Point(0, 0, 0), Factor=F)  # -> Geometry, Transform
scale_7 = Scale(Geometry=ceiling_2, Center=Point(0, 0, 0), Factor=F)  # -> Geometry, Transform
floor_2 = Brep(scale_3.Geometry)
wall_2 = Brep(scale_5.Geometry)
ceiling_4 = Brep(scale_2.Geometry)
glazing_2 = Brep(scale_6.Geometry)
mullion_2 = Brep(scale_4.Geometry)
ceiling_5 = Brep(scale.Geometry)
ceiling_6 = Brep(scale_7.Geometry)
get_cs_lightingmaterial = GetCSLightingMaterial(UnitSystem=4)
get_cs_lightingmaterial_2 = GetCSLightingMaterial(Search="ceiling lm83", UnitSystem=4)
get_cs_lightingmaterial_3 = GetCSLightingMaterial(Search="floor lm83", UnitSystem=4)
get_cs_lightingmaterial_4 = GetCSLightingMaterial(UnitSystem=4)
get_cs_lightingmaterial_5 = GetCSLightingMaterial(Search="wall lm83", UnitSystem=4)
get_cs_lightingmaterial_6 = GetCSLightingMaterial(UnitSystem=4)
get_cs_lightingmaterial_7 = GetCSLightingMaterial(Search="White Table Top", UnitSystem=4)
construct_cs_scenelayer = ConstructCSSceneLayer(
    Name="monitor",
    Material=get_cs_lightingmaterial,
    Geometry=ceiling_5,
    Input_0_Hidden=False,
    Input_0_Name="Name",
    Input_1_Hidden=False,
    Input_1_Name="Material",
    Input_2_Hidden=False,
    Input_2_Name="Geometry",
    Input_3_Hidden=True,
    Input_3_Name="ViewTag",
    UnitSystem=4,
    Input_3_GHParam_Branch0_Path="{0}",
    Input_3_GHParam_Branch0_Item0_null_string=False,
    Input_3_GHParam_Branch0_Item0_string="None")
construct_cs_scenelayer_2 = ConstructCSSceneLayer(
    Name="CEILING",
    Material=get_cs_lightingmaterial_2,
    Geometry=ceiling_4,
    Input_0_Hidden=False,
    Input_0_Name="Name",
    Input_1_Hidden=False,
    Input_1_Name="Material",
    Input_2_Hidden=False,
    Input_2_Name="Geometry",
    Input_3_Hidden=True,
    Input_3_Name="ViewTag",
    UnitSystem=4,
    Input_3_GHParam_Branch0_Path="{0}",
    Input_3_GHParam_Branch0_Item0_null_string=False,
    Input_3_GHParam_Branch0_Item0_string="None")
construct_cs_scenelayer_3 = ConstructCSSceneLayer(
    Name="FLOOR",
    Material=get_cs_lightingmaterial_3,
    Geometry=floor_2,
    Input_0_Hidden=False,
    Input_0_Name="Name",
    Input_1_Hidden=False,
    Input_1_Name="Material",
    Input_2_Hidden=False,
    Input_2_Name="Geometry",
    Input_3_Hidden=True,
    Input_3_Name="ViewTag",
    UnitSystem=4,
    Input_3_GHParam_Branch0_Path="{0}",
    Input_3_GHParam_Branch0_Item0_null_string=False,
    Input_3_GHParam_Branch0_Item0_string="None")
construct_cs_scenelayer_4 = ConstructCSSceneLayer(
    Name="MULLION",
    Material=get_cs_lightingmaterial_4,
    Geometry=mullion_2,
    Input_0_Hidden=False,
    Input_0_Name="Name",
    Input_1_Hidden=False,
    Input_1_Name="Material",
    Input_2_Hidden=False,
    Input_2_Name="Geometry",
    Input_3_Hidden=True,
    Input_3_Name="ViewTag",
    UnitSystem=4,
    Input_3_GHParam_Branch0_Path="{0}",
    Input_3_GHParam_Branch0_Item0_null_string=False,
    Input_3_GHParam_Branch0_Item0_string="None")
construct_cs_scenelayer_5 = ConstructCSSceneLayer(
    Name="WALL",
    Material=get_cs_lightingmaterial_5,
    Geometry=wall_2,
    Input_0_Hidden=False,
    Input_0_Name="Name",
    Input_1_Hidden=False,
    Input_1_Name="Material",
    Input_2_Hidden=False,
    Input_2_Name="Geometry",
    Input_3_Hidden=True,
    Input_3_Name="ViewTag",
    UnitSystem=4,
    Input_3_GHParam_Branch0_Path="{0}",
    Input_3_GHParam_Branch0_Item0_null_string=False,
    Input_3_GHParam_Branch0_Item0_string="None")
construct_cs_scenelayer_6 = ConstructCSSceneLayer(
    Name="GLAZING",
    Material=get_cs_lightingmaterial_6,
    Geometry=glazing_2,
    Input_0_Hidden=False,
    Input_0_Name="Name",
    Input_1_Hidden=False,
    Input_1_Name="Material",
    Input_2_Hidden=False,
    Input_2_Name="Geometry",
    Input_3_Hidden=True,
    Input_3_Name="ViewTag",
    UnitSystem=4,
    Input_3_GHParam_Branch0_Path="{0}",
    Input_3_GHParam_Branch0_Item0_null_string=False,
    Input_3_GHParam_Branch0_Item0_string="None")
construct_cs_scenelayer_7 = ConstructCSSceneLayer(
    Name="TABLE",
    Material=get_cs_lightingmaterial_7,
    Geometry=ceiling_6,
    Input_0_Hidden=False,
    Input_0_Name="Name",
    Input_1_Hidden=False,
    Input_1_Name="Material",
    Input_2_Hidden=False,
    Input_2_Name="Geometry",
    Input_3_Hidden=True,
    Input_3_Name="ViewTag",
    UnitSystem=4,
    Input_3_GHParam_Branch0_Path="{0}",
    Input_3_GHParam_Branch0_Item0_null_string=False,
    Input_3_GHParam_Branch0_Item0_string="None")
data = Data(flatten([construct_cs_scenelayer_2, construct_cs_scenelayer_3, construct_cs_scenelayer_4, construct_cs_scenelayer_5, construct_cs_scenelayer_6, construct_cs_scenelayer_7]))

# ----
# ceiling lights position
number_slider_2 = Slider(3, range=0..10)
surface = Surface(<surface referenced from the Rhino model>)
divide_surface = DivideSurface(Surface=surface, UCount=number_slider_2, VCount=Slider(8, range=0..10))  # -> flatten(Points), Normals, Parameters
scale_8 = Scale(Geometry=divide_surface.Points, Center=Point(0, 0, 0), Factor=F)  # -> Geometry, Transform
point_list = PointList(Points=scale_8.Geometry)
lightpos = Point(scale_8.Geometry)
panel_3 = Panel("""16
17
25
26
34
35""")
xy_plane = XYPlane(Origin=Point(0, 0, 0))
cull_index = CullIndex(List=lightpos, Indices=panel_3, Wrap=True)
rotate = Rotate(Geometry=xy_plane, Angle=degrees(Slider(0, range=0..100)), Plane=PlaneXY(0, 0, 0))  # -> Geometry, Transform
plane_origin = PlaneOrigin(Base=rotate.Geometry, Origin=cull_index)
vector_xyz = VectorXYZ(XComponent=Slider(0.55, range=0..1), YComponent=0, ZComponent=Slider(2.6, range=0..10))  # -> Vector, Length
move = Move(Geometry=plane_origin, Motion=vector_xyz.Vector)  # -> Geometry, Transform

# ----
# task areas
# seats number
# surrounding areas
number_slider_3 = Slider(2, range=0..10)
deconstruct_brep = DeconstructBrep(Brep=ceiling_6)  # -> Faces, Edges, Vertices
list_item_2 = ListItem(List=deconstruct_brep.Edges, Index=number_slider_3, Wrap=True)
curve_middle = CurveMiddle(Curve=list_item_2)  # -> flatten(Midpoint)
number_slider_4 = Slider(1, range=0..10)  # disabled
evaluate_curve = EvaluateCurve(Curve=reparameterize(flatten(list_item_2)), Parameter=flatten("0.5"))  # -> Point, Tangent, Angle
point_list_2 = PointList(Points=curve_middle, Size=number_slider_4)  # disabled
vector_display = VectorDisplay(Anchor=curve_middle, Vector=evaluate_curve.Tangent)  # disabled
rotate_2 = Rotate(Geometry=evaluate_curve.Tangent, Angle=degrees("-90"), Plane=PlaneXY(0, 0, 0))  # -> Geometry, Transform
vector_display_2 = VectorDisplay(Anchor=curve_middle, Vector=rotate_2.Geometry)  # disabled
number_slider_5 = Slider(0.7, range=0..1)
panel_4 = Panel("-0.5")
center_box = CenterBox(Base=curve_middle, X=Slider(1, range=0..1), Y=Slider(0.5, range=0..1), Z=Slider(0, range=0..100))  # -> graft(Box)
multiplication_2 = Multiplication(A=rotate_2.Geometry, B="-0.5")
multiplication_3 = Multiplication(A=evaluate_curve.Tangent, B="-0.5", C=number_slider_5)
line_sdl = LineSDL(Start=curve_middle, Direction=evaluate_curve.Tangent, Length=number_slider_5)
deconstruct_brep_2 = DeconstructBrep(Brep=center_box)  # -> Faces, Edges, Vertices
line_sdl_2 = LineSDL(Start=curve_middle, Direction=multiplication_2, Length=multiplication_2)  # -> graft(Line)
move_2 = Move(Geometry=line_sdl, Motion=multiplication_3)  # -> graft(Geometry), Transform
sweep1 = Sweep1(Rail=line_sdl_2, Sections=move_2.Geometry, Miter=1)  # -> flatten(Brep)
list_item_3 = ListItem(List=deconstruct_brep_2.Faces, Index=Slider(5, range=0..10), Wrap=True)  # -> flatten(Item)
list_item_4 = ListItem(List=list_item_3, Index="-1", Wrap=True)
area = Area(Geometry=list_item_4)  # -> Area, Centroid
rotate_3 = Rotate(Geometry=list_item_4, Angle=degrees("90"), Plane=area.Centroid)  # -> Geometry, Transform
replace_items = ReplaceItems(List=list_item_3, Item=rotate_3.Geometry, Indices=Slider(22, range=0..100), Wrap=False)
region_difference = RegionDifference(CurvesA=graft(replace_items), CurvesB=graft(sweep1))  # -> flatten(Result)

# ----
# light analysis plan
grid = Brep(<brep referenced from the Rhino model>)
scale_9 = Scale(Geometry=grid, Center=Point(0, 0, 0), Factor=F)  # -> Geometry, Transform
grid_2 = Brep(scale_9.Geometry)
construct_cs_sensorgrid = ConstructCSSensorGrid(
    Level="LEVEL 01",
    Id="101",
    Description="Open office",
    Geometry=grid_2,
    Spacing=Slider(0.2, range=0..1),
    Input_0_Hidden=True,
    Input_0_Name="Building",
    Input_10_Hidden=True,
    Input_10_Name="SupplementalLux",
    Input_11_Hidden=True,
    Input_11_Name="TargetLux",
    Input_12_Hidden=True,
    Input_12_Name="ExcessiveLux",
    Input_13_Hidden=True,
    Input_13_Name="sDA_Time",
    Input_14_Hidden=True,
    Input_14_Name="BREEAMSpaceType",
    Input_15_Hidden=True,
    Input_15_Name="ViewOffset",
    Input_16_Hidden=True,
    Input_16_Name="ViewDirections",
    Input_17_Hidden=True,
    Input_17_Name="ViewRotation",
    Input_18_Hidden=True,
    Input_18_Name="Points Override",
    Input_19_Hidden=True,
    Input_19_Name="Normals Override",
    Input_1_Hidden=False,
    Input_1_Name="Level",
    Input_20_Hidden=True,
    Input_20_Name="Disk Radius",
    Input_21_Hidden=True,
    Input_21_Name="Max Radius",
    Input_22_Hidden=True,
    Input_22_Name="Normal Override"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)

changegui = ChangeGui(
    Switcher=ColourSwatch(SwatchColor=RGB(255, 255, 255)),
    Canvas_back=ColourSwatch(SwatchColor=RGB(19, 93, 105)),
    Canvas_grid=ColourSwatch(SwatchColor=RGB(143, 143, 143)),
    Canvas_wire=RGB(255, 255, 255))
place_cs_luminaire = PlaceCSLuminaire(
    LuminaireProduct=list_item,
    Plane=move.Geometry,
    WebSize=1,
    Output_0_Hidden=False,
    Output_0_Name="Luminaire",
    Output_1_Hidden=True,
    Output_1_Name="Lumens",
    UnitSystem=4,
    showArrow=True,
    showH=False,
    showV=True,
    showWireframe=True)

# ----
# occupant location 0-22
# occupant count 0-10
number_slider_6 = Slider(330, range=0..1000)
random = Random(Range="1 to 11", Number="1", Seed=number_slider_6)
panel_5 = Panel(random)
integer = Integer(random)
panel_6 = Panel(integer)
# output where people sit
random_2 = Random(Range="0 to 22.99", Number=integer, Seed=number_slider_6)
integer_2 = Integer(random_2)

number_slider_7 = Slider(1, range=0..10)
construct_cs_daylightmodel = ConstructCSDaylightModel(
    SceneLayers=data,
    Luminaires=place_cs_luminaire,
    SensorGrids=construct_cs_sensorgrid,
    NorthOffset=0,
    Input_0_Hidden=False,
    Input_0_Name="SceneLayers",
    Input_1_Hidden=True,
    Input_1_Name="Windows",
    Input_2_Hidden=False,
    Input_2_Name="Luminaires",
    Input_3_Hidden=False,
    Input_3_Name="Tubular Devices",
    Input_4_Hidden=False,
    Input_4_Name="SensorGrids",
    Input_5_Hidden=False,
    Input_5_Name="Camera",
    Input_6_Hidden=False,
    Input_6_Name="North Offset",
    UnitSystem=4)
fc_max = Panel("500")
run = Button()
construct_domain = ConstructDomain(DomainStart=0, DomainEnd=fc_max)
get_cs_gradient = GetCSGradient(Steps=0, UnitSystem=4)
run_cs_illuminance = RunCSIlluminance(
    Name="Simple Office\Electric Lighting",
    Model=construct_cs_daylightmodel,
    Samples=4096,
    Run=run,
    Input_0_Hidden=False,
    Input_0_Name="Name",
    Input_10_Hidden=False,
    Input_10_Name="Run",
    Input_1_Hidden=False,
    Input_1_Name="Model",
    Input_2_Hidden=False,
    Input_2_Name="Sky",
    Input_3_Hidden=False,
    Input_3_Name="Samples",
    Input_4_Hidden=True,
    Input_4_Name="Threads",
    Input_5_Hidden=True,
    Input_5_Name="Radiance Params",
    Input_6_Hidden=True,
    Input_6_Name="Spectral",
    Input_7_Hidden=True,
    Input_7_Name="Ambient Bounces",
    Input_8_Hidden=True,
    Input_8_Name="Hide Pop-up",
    Input_9_Hidden=True,
    Input_9_Name="Weight Limit",
    UnitSystem=4,
    Input_4_GHParam_Branch0_Path="{0}",
    Input_4_GHParam_Branch0_Item0_number=0,
    Input_6_GHParam_Branch0_Path="{0}",
    Input_6_GHParam_Branch0_Item0_boolean=False,
    Input_7_GHParam_Branch0_Path="{0}",
    Input_7_GHParam_Branch0_Item0_number=6,
    Input_8_GHParam_Branch0_Path="{0}",
    Input_8_GHParam_Branch0_Item0_boolean=False,
    Input_9_GHParam_Branch0_Path="{0}",
    Input_9_GHParam_Branch0_Item0_number=0.01)

# ----
# random occupant task
# and surrounding areas
list_item_5 = ListItem(List=sweep1, Index=integer_2, Wrap=True)  # -> graft(Item)
list_item_6 = ListItem(List=region_difference, Index=integer_2, Wrap=True)  # -> graft(Item)

construct_cs_falsecolor = ConstructCSFalsecolor(GradientS=get_cs_gradient, DomainS=construct_domain, Log=False, Decades=3, UnitSystem=4)
load_cs_result = LoadCSResult(
    Result=run_cs_illuminance,
    Header=False,
    Output_0_Hidden=False,
    Output_0_Name="Name",
    Output_10_Hidden=True,
    Output_10_Name="Window Groups",
    Output_11_Hidden=True,
    Output_11_Name="Weather",
    Output_12_Hidden=True,
    Output_12_Name="North",
    Output_13_Hidden=True,
    Output_13_Name="LayerNames",
    Output_14_Hidden=True,
    Output_14_Name="LayerObjects",
    Output_15_Hidden=True,
    Output_15_Name="LayerMaterials",
    Output_16_Hidden=True,
    Output_16_Name="Sky",
    Output_1_Hidden=False,
    Output_1_Name="Type",
    Output_2_Hidden=True,
    Output_2_Name="Standard",
    Output_3_Hidden=True,
    Output_3_Name="Date",
    Output_4_Hidden=True,
    Output_4_Name="Version",
    Output_5_Hidden=True,
    Output_5_Name="FileSize",
    Output_6_Hidden=True,
    Output_6_Name="RunLog",
    Output_7_Hidden=False,
    Output_7_Name="Metrics",
    Output_8_Hidden=False,
    Output_8_Name="MetricValues",
    Output_9_Hidden=False,
    Output_9_Name="Grids",
    UnitSystem=4)  # -> Name, Type, Metrics, MetricValues, Grids
preview_cs_sensorgrid = PreviewCSSensorGrid(
    Grid=load_cs_result.Grids,
    Metric="Illuminance [lux]",
    Falsecolor=construct_cs_falsecolor,
    Input_0_Hidden=False,
    Input_0_Name="Grid",
    Input_1_Hidden=False,
    Input_1_Name="Metric",
    Input_2_Hidden=False,
    Input_2_Name="Falsecolor",
    Input_3_Hidden=True,
    Input_3_Name="Sensor Values",
    Input_4_Hidden=True,
    Input_4_Name="Show Points",
    Input_5_Hidden=True,
    Input_5_Name="Show Edges",
    Input_6_Hidden=True,
    Input_6_Name="Show Labels",
    Input_7_Hidden=True,
    Input_7_Name="Label Format",
    Input_8_Hidden=True,
    Input_8_Name="Transform",
    Input_9_Hidden=True,
    Input_9_Name="Max Radius",
    Output_0_Hidden=True,
    Output_0_Name="Mesh",
    Output_1_Hidden=True,
    Output_1_Name="Texture",
    UnitSystem=4,
    Input_4_GHParam_Branch0_Path="{0}",
    Input_4_GHParam_Branch0_Item0_boolean=True,
    Input_5_GHParam_Branch0_Path="{0}",
    Input_5_GHParam_Branch0_Item0_boolean=True,
    Input_6_GHParam_Branch0_Path="{0}",
    Input_6_GHParam_Branch0_Item0_boolean=False,
    Input_9_GHParam_Branch0_Path="{0}",
    Input_9_GHParam_Branch0_Item0_number=0)
list_length = ListLength(List=load_cs_result.Metrics)
duplicate_data = DuplicateData(Data="************************", Number=list_length, Order=True)
unit_z = UnitZ(Factor=1)
unit_z_2 = UnitZ(Factor=1)
extract_cs_sensorgrid_data = ExtractCSSensorGridData(
    Grid=load_cs_result.Grids,
    Metric="Illuminance [lux]",
    Input_0_Hidden=False,
    Input_0_Name="Grid",
    Input_1_Hidden=False,
    Input_1_Name="Metric",
    UnitSystem=4)  # -> Metric, ValueS
deconstruct_cs_sensorgrid = DeconstructCSSensorGrid(
    Grid=load_cs_result.Grids,
    Output_0_Hidden=False,
    Output_0_Name="Building",
    Output_10_Hidden=True,
    Output_10_Name="Analysis Surface",
    Output_11_Hidden=True,
    Output_11_Name="Edges",
    Output_12_Hidden=True,
    Output_12_Name="View Points",
    Output_13_Hidden=True,
    Output_13_Name="Area",
    Output_14_Hidden=True,
    Output_14_Name="View Directions",
    Output_15_Hidden=False,
    Output_15_Name="Occupancy",
    Output_16_Hidden=True,
    Output_16_Name="View Wedges",
    Output_17_Hidden=True,
    Output_17_Name="Supplemental Lux",
    Output_18_Hidden=True,
    Output_18_Name="Target Lux",
    Output_19_Hidden=True,
    Output_19_Name="Excessive Lux",
    Output_1_Hidden=False,
    Output_1_Name="Level",
    Output_20_Hidden=True,
    Output_20_Name="Normal Override",
    Output_21_Hidden=True,
    Output_21_Name="Use Normal Override",
    Output_22_Hidden=True,
    Output_22_Name="Perimeter Edges"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)  # -> Building, Level, ID, SensorPoints, Occupancy
weave = Weave(
    Pattern=[0, 1, 2],
    Stream0=duplicate_data,
    Stream1=load_cs_result.Metrics,
    Stream2=load_cs_result.MetricValues,
    NullGaps=False)
extrude = Extrude(Base=list_item_6, Direction=unit_z)
extrude_2 = Extrude(Base=list_item_5, Direction=unit_z_2)
metrics = Panel(weave)
cap_holes = CapHoles(Brep=extrude)
panel_7 = Panel(extract_cs_sensorgrid_data.ValueS)  # disabled
point_in_brep = PointInBrep(Brep=extrude_2, Point=deconstruct_cs_sensorgrid.SensorPoints, Strict=False)
point_in_brep_2 = PointInBrep(Brep=cap_holes, Point=deconstruct_cs_sensorgrid.SensorPoints, Strict=False)
text_tag = TextTag(Location=deconstruct_cs_sensorgrid.SensorPoints, Text=extract_cs_sensorgrid_data.ValueS)  # disabled
dispatch = Dispatch(List=deconstruct_cs_sensorgrid.SensorPoints, DispatchPattern=point_in_brep_2)  # -> ListA, ListB
dispatch_2 = Dispatch(List=deconstruct_cs_sensorgrid.SensorPoints, DispatchPattern=point_in_brep)  # -> ListA, ListB
dispatch_3 = Dispatch(List=extract_cs_sensorgrid_data.ValueS, DispatchPattern=point_in_brep_2)  # -> ListA, ListB
dispatch_4 = Dispatch(List=extract_cs_sensorgrid_data.ValueS, DispatchPattern=point_in_brep)  # -> ListA, ListB
cs_workflow_templates = CSWorkflowTemplates()
# Mean Illuminance of surrounding area [lux]
# Each should > 300 lux
point = Point(dispatch.ListA)
# Mean Illuminance of task area [lux]
# Each should > 500 lux
point_2 = Point(dispatch_2.ListA)
average = Average(Input=dispatch_4.ListA)  # -> flatten(ArithmeticMean)
average_2 = Average(Input=dispatch_3.ListA)  # -> flatten(ArithmeticMean)
